# Grasshopper definition box-lasercutting-v2.gh (Grasshopper 1.0.8)

# ---- group: 01 — Global Dimensions
number_slider = Slider(100, range=80..300)
number_slider_2 = Slider(80, range=50..250)
number_slider_3 = Slider(60, range=55..200)
number_slider_4 = Slider(30, range=25..150)

# ---- group: 02 — Material + Fit
number_slider_5 = Slider(3, range=2..6)
number_slider_6 = Slider(0.15, range=0..0.4)
number_slider_7 = Slider(0.15, range=0..0.5)

# ---- group: 03 — MakerCase M3 T-Slot System
# ONE template, 8 instances.
# Screw axis lies in the mating sheet plane.
# Crossbar = nut AF + clearance by nut thickness + clearance.
# Two flanking tabs locate the panels.
# Nut flats prevent rotation; shoulders resist screw tension.
# Load nuts through the sheet face, then insert screws.
# All fit clearances are TOTAL additions.
# Upper screw axes lowered: nuts load from underneath Top; retaining shoulders and anti-rotation flats still engage.
number_slider_8 = Slider(3, range=2.8..3.2)
number_slider_9 = Slider(0.5, range=0..1)
py3 = Python3Script(
    MaterialThickness=number_slider_5,
    SlotClearance=number_slider_7,
    KerfCompensation=number_slider_6,
    M3BoltDiameter=number_slider_8,
    M3BoltClearance=Slider(0.3, range=0.1..0.6),
    M3NutWidthAcrossFlats=Slider(5.5, range=5.3..5.7),
    M3NutThickness=Slider(2.4, range=2.2..2.6),
    M3NutClearance=Slider(0.2, range=0.1..0.4))  # -> out, TSlot, Tabs, ReceiverSlots, ScrewHole, Spec, FitValues
# ---------- py3: Python ----------
"""ONE reusable edge-on M3 captive-hex-nut T-slot template.
Local coordinates: U = edge tangent, V = inward from mating edge.
The nut axis runs parallel to the sheet plane (upper axes offset below Top).
Therefore the laser-cut nut seat
is AF-wide by nut-thickness-deep, not a face-on hexagon. Two flats
prevent rotation; the shoulders resist screw tension. Nuts load through
the sheet face before tightening. All external joints instance this template.
Clearances are TOTAL additions, not per-side. Geometry is finished size.
"""
import Rhino.Geometry as rg
import json, math
T,SC,K,BD,BC,AF,NT,NC = [float(v) for v in (MaterialThickness,SlotClearance,KerfCompensation,M3BoltDiameter,M3BoltClearance,M3NutWidthAcrossFlats,M3NutThickness,M3NutClearance)]
assert min(T,BD,AF,NT)>0 and min(SC,K,BC,NC)>=0
r=(BD+BC)/2.0
nw=AF+NC; nh=NT+NC
assert nw>2*r and K<min(T+SC,2*r,nh)
tab=2*T
pitch=nw/2+tab/2+T/2
seat=max(2*T,nh/2+T)
end=seat+nh/2+BD/2
rim=max(T,AF/math.sqrt(3)+NC-T/2,r+0.8-T/2)
eps=0.01

def poly(points):
 p=[rg.Point3d(x,y,0) for x,y in points]; p.append(p[0]); return rg.PolylineCurve(p)
def rect(x0,y0,x1,y1): return poly([(x0,y0),(x1,y0),(x1,y1),(x0,y1)])
TSlot=poly([(-r,-eps),(r,-eps),(r,seat-nh/2),(nw/2,seat-nh/2),(nw/2,seat+nh/2),(r,seat+nh/2),(r,end),(-r,end),(-r,seat+nh/2),(-nw/2,seat+nh/2),(-nw/2,seat-nh/2),(-r,seat-nh/2)])
Tabs=[rect(u-tab/2,-T,u+tab/2,eps) for u in (-pitch,pitch)]
ReceiverSlots=[rect(u-(tab+SC)/2,-(T+SC)/2,u+(tab+SC)/2,(T+SC)/2) for u in (-pitch,pitch)]
ScrewHole=rg.Circle(rg.Plane.WorldXY,r).ToNurbsCurve()
Spec=json.dumps(dict(t=T,fit=SC,kerf=K,bolt=BD,bolt_clear=BC,af=AF,nt=NT,nut_clear=NC,hole=2*r,nut_width=nw,nut_depth=nh,tab=tab,pitch=pitch,seat=seat,end=end,rim=rim))
FitValues='Finished / laser-centerline dimensions (mm)\nScrew: %.3f / %.3f\nNut AF seat: %.3f / %.3f\nNut axial seat: %.3f / %.3f\nSheet slot: %.3f / %.3f\nAlignment tab: %.3f / %.3f\nReference rim offset (not upper lip): %.3f\nKerf is full beam width; centerline offset = K/2.'%(2*r,2*r-K,nw,nw-K,nh,nh-K,T+SC,T+SC-K,tab,tab+K,rim)
# ---------- end py3 ----------
panel = Panel(py3.FitValues)

# ---- group: 07 — Top M4 OS20 Mounts
# Top center = (W/2, (D-T)/2). Primary holes: center +/- one OS20 pitch in X and Y. Optional pair: center +/- two pitches in X. Finished hole size is controlled by TopMountHoleDiameter. All positions are validated against the Top outline, T-slots, Divider slots, other mounts, and the 3 mm ligament policy; unsafe points are not shifted.
number_slider_10 = Slider(4.5, range=4..7)
number_slider_11 = Slider(20, range=10..35)
toggle = BooleanToggle(True)

# ---- group: 05 — Internal Divider
py3_2 = Python3Script(
    Spec=py3.Spec,
    BoxWidth=number_slider,
    BoxHeight=number_slider_2,
    BoxDepth=number_slider_3,
    DividerOffsetFromFront=number_slider_4)  # -> out, DividerEdges, Direction, TopBottomSlots, SideSlots, RearChamberDepth, DividerInfo, KerfCenterline
# ---------- py3_2: Python ----------
"""Tab-only divider. Front face is at DividerOffsetFromFront.
Two tabs into EACH surrounding panel; no screw or nut features here.
Outputs stay in assembly coordinates except matching slot templates.
"""
import Rhino.Geometry as rg
import json
s=json.loads(str(Spec)); t=s['t']; c=s['fit']; rim=s['rim']; tw=2*t
W,H,D,F=[float(v) for v in (BoxWidth,BoxHeight,BoxDepth,DividerOffsetFromFront)]
assert 0<F and F+t<D-t, 'Divider must leave two positive chambers.'
lo=rim+t; hi=H-rim-t
assert W>8*t and hi-lo>6*t

def rect(a,b,c,d):
 return rg.PolylineCurve([rg.Point3d(a,b,0),rg.Point3d(c,b,0),rg.Point3d(c,d,0),rg.Point3d(a,d,0),rg.Point3d(a,b,0)])
xs=[t+(W-2*t)*f for f in (1.0/3,2.0/3)]
zs=[lo+(hi-lo)*f for f in (1.0/3,2.0/3)]
parts=[rect(t+c/2,lo+c/2,W-t-c/2,hi-c/2)]
for z in zs:
 parts.extend([rect(0,z-tw/2,t+c/2+0.01,z+tw/2),rect(W-t-c/2-0.01,z-tw/2,W,z+tw/2)])
for x in xs:
 parts.extend([rect(x-tw/2,rim,x+tw/2,lo+c/2+0.01),rect(x-tw/2,hi-c/2-0.01,x+tw/2,H-rim)])
cs=rg.Curve.CreateBooleanUnion(parts,0.001)
assert cs and len(cs)==1, 'Divider tabs must remain connected.'
plane=rg.Plane(rg.Point3d(0,F,0),rg.Vector3d.XAxis,rg.Vector3d.ZAxis)
xf=rg.Transform.PlaneToPlane(rg.Plane.WorldXY,plane)
DividerEdges=[cs[0].DuplicateCurve()]; DividerEdges[0].Transform(xf)
# Separate kerf centerline in the SAME assembly plane (no fabrication layout).
cut=cs[0].DuplicateCurve()
if s['kerf']>0:
 area=abs(rg.AreaMassProperties.Compute(cut).Area); found=None
 for distance in [s['kerf']/2,-s['kerf']/2]:
  offsets=cut.Offset(rg.Plane.WorldXY,distance,0.001,rg.CurveOffsetCornerStyle.Sharp)
  if offsets and len(offsets)==1 and offsets[0].IsClosed and abs(rg.AreaMassProperties.Compute(offsets[0]).Area)>area:
   found=offsets[0];break
 assert found is not None, 'Divider kerf offset failed.'
 cut=found
cut.Transform(xf)
KerfCenterline=cut
Direction=rg.Vector3d(0,t,0)
TopBottomSlots=[rect(x-(tw+c)/2,F-c/2,x+(tw+c)/2,F+t+c/2) for x in xs]
SideSlots=[rect(F-c/2,z-(tw+c)/2,F+t+c/2,z+(tw+c)/2) for z in zs]
RearChamberDepth=D-t-(F+t)
DividerInfo='TAB ONLY | 8 tabs, 0 screws, 0 nuts\nFront face Y = %.3f mm\nBack face Y = %.3f mm\nOpen rear edge Y = %.3f mm\nClear depth to open rear = D - T - (F + T) = %.3f mm\nBody fits inside Top/Bottom/Left/Right; total fit clearance %.3f mm.'%(F,F+t,D-t,RearChamberDepth,c)
# ---------- end py3_2 ----------
panel_2 = Panel(py3_2.RearChamberDepth)
panel_3 = Panel(py3_2.DividerInfo)

# ---- group: 09 — 28BYJ-48 Motor Mounting Interface
# FIXED MOTOR SPEC (mm)
# Body: diameter 28.0; depth 19.0
# Mount holes: 2 x diameter 4.0; spacing 35.0 center-to-center
# Shaft offset: X 0.0; Z +8.0 from body / mounting-ear midpoint
# Boss / divider clearance: diameter 9.0
# Shaft: nominal 5.0; double-flat 3.0; flat length 6.0; front projection 10.0
# Flange thickness 1.0; ear outer height 7.0
# Connector width 14.6; lower extent 17.0; DOWN at rotation 0 degrees
# USER CONTROLS: MotorPositionX, MotorPositionZ, MotorRotation only.
number_slider_12 = Slider(70, range=50..75)
swatch = ColourSwatch(SwatchColor=RGB(202, 208, 217))

# ---- group: 08 — Microswitch Bracket + Mounting Interfaces
# BracketThickness = MaterialThickness.
# Offset = divider front face to bracket REAR face.
# Bracket front/rear faces are Y=8.600 / 11.600 mm at the implemented 18.400 mm offset.
# Exactly TWO bracket attachment screws: Left and Bottom.
# Switch slots remain separate, fixed-pitch, and retain shared horizontal adjustment.
# MicroswitchAdjustment = TOTAL slot travel.
# KW11 body and lever are approximate references, not laser-cut parts.
# Complete bracket/switch assembly translated rigidly +4.000 mm in Y; roller center X=34.000 Y=19.800 Z=24.700 mm.
# Bottom guide hole remains unchanged at X=24.000 Y=23.000 diameter 6.000 mm.
number_slider_13 = Slider(18.4, range=1..25)
py3_3 = Python3Script(
    Spec=py3.Spec,
    BoxWidth=number_slider,
    BoxHeight=number_slider_2,
    BoxDepth=number_slider_3,
    DividerOffsetFromFront=number_slider_4,
    MicroswitchBracketOffsetFromDivider=number_slider_13,
    MicroswitchBracketHeight=Slider(35, range=30..60),
    MicroswitchBracketBaseLength=Slider(40, range=32..60),
    MicroswitchHoleSpacing=Slider(9.5, range=7..15),
    MicroswitchMountHeight=Slider(25, range=15..35),
    MicroswitchMountHoleDiameter=Slider(2.2, range=2..3),
    MicroswitchAdjustment=Slider(3, range=0.5..6),
    TSlot=py3.TSlot,
    Tabs=py3.Tabs,
    ReceiverSlots=py3.ReceiverSlots,
    ScrewHole=py3.ScrewHole)  # -> out, BracketEdges, Direction, LeftInterfaceCuts, BottomInterfaceCuts, Screws, Nuts, SwitchBody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; inputs Tabs: list, ReceiverSlots: list
# ---------- py3_3: Python ----------
"""One flat bracket, two instances of the EXISTING M3 joint template.
Bracket lies in XZ, seated at Left inner face and Bottom upper face.
Switch/lever/roller are approximate assembly references, not laser-cut parts.
Adjustment denotes TOTAL horizontal travel shared by both mounting slots.
"""
import Rhino.Geometry as rg
import rhinoscriptsyntax as rs
import json,math
s=json.loads(str(Spec));t=s['t'];fit=s['fit'];tol=.001
W,H,D,F=[float(v) for v in (BoxWidth,BoxHeight,BoxDepth,DividerOffsetFromFront)]
height,base,requested_offset,pitch,mount_height,hole_d,adjust=[float(v) for v in (MicroswitchBracketHeight,MicroswitchBracketBaseLength,MicroswitchBracketOffsetFromDivider,MicroswitchHoleSpacing,MicroswitchMountHeight,MicroswitchMountHoleDiameter,MicroswitchAdjustment)]
floor=s['rim']+t;left=t;top=H-s['rim'];rnut=s['af']/math.sqrt(3)
# Include rear protrusion of the edge-on captive hex nuts when limiting offset.
effective_offset=max(requested_offset,rnut-t/2+max(s['nut_clear'],.1))
y_rear=F-effective_offset;y_front=y_rear-t;yc=(y_front+y_rear)/2
assert y_front>0 and base>2*s['end']+t and height>2*s['pitch']+s['tab']+t
assert left+base<W-t and floor+height<top-t

def crv(v):
 if hasattr(v,'Value'):v=v.Value
 return v if isinstance(v,rg.Curve) else rs.coercecurve(v)
TSlot=crv(TSlot);ScrewHole=crv(ScrewHole)
Tabs=[crv(v) for v in Tabs];ReceiverSlots=[crv(v) for v in ReceiverSlots]
def polygon(points):
 a=[rg.Point3d(x,z,0) for x,z in points];a.append(a[0]);return rg.PolylineCurve(a)
def rectangle(x0,z0,x1,z1):return polygon([(x0,z0),(x1,z0),(x1,z1),(x0,z1)])
def place(curve,origin,u,v):
 p=rg.Plane(rg.Point3d(*origin),rg.Vector3d(*u),rg.Vector3d(*v));a=curve.DuplicateCurve();a.Transform(rg.Transform.PlaneToPlane(rg.Plane.WorldXY,p));return a
def local(curve,x,z,u,v):return place(curve,(x,z,0),(u[0],u[1],0),(v[0],v[1],0))
# A simple clipped triangular gusset with enough upper material for the switch.
outline=polygon([(left,floor),(left+base,floor),(left+base,floor+.30*height),(left+.65*base,floor+height),(left,floor+height)])
z_left=floor+.45*height;x_bottom=left+.625*base
assert z_left-s['pitch']-s['tab']/2>floor+.5
assert z_left+s['pitch']+s['tab']/2<floor+height-.5
assert x_bottom-s['pitch']-s['tab']/2>left+s['end']+.5
assert x_bottom+s['pitch']+s['tab']/2<left+base-.5
joint_tabs=[local(a,left,z_left,(0,1),(1,0)) for a in Tabs]+[local(a,x_bottom,floor,(1,0),(0,1)) for a in Tabs]
joint_cuts=[local(TSlot,left,z_left,(0,1),(1,0)),local(TSlot,x_bottom,floor,(1,0),(0,1))]
union=rg.Curve.CreateBooleanUnion([outline]+joint_tabs,tol)
assert union and len(union)==1
# Switch hole pair stays at a fixed pitch; both slots share adjustment travel.
mount_x=left+.425*base;mount_z=floor+mount_height
mount_centers=[mount_x-pitch/2,mount_x+pitch/2];mount_slots=[]
assert adjust>0 and hole_d>0 and pitch>adjust+hole_d+t
for x in mount_centers:
 r=hole_d/2;halfa=adjust/2
 pieces=[rectangle(x-halfa,mount_z-r,x+halfa,mount_z+r),rg.Circle(rg.Point3d(x-halfa,mount_z,0),r).ToNurbsCurve(),rg.Circle(rg.Point3d(x+halfa,mount_z,0),r).ToNurbsCurve()]
 slot=rg.Curve.CreateBooleanUnion(pieces,tol);assert slot and len(slot)==1
 mount_slots.append(slot[0])
pre=rg.Curve.CreateBooleanDifference(union[0],joint_cuts,tol);assert pre
pre_faces=rg.Brep.CreatePlanarBreps(pre,tol);assert pre_faces and len(pre_faces)==1
final=rg.Curve.CreateBooleanDifference(union[0],joint_cuts+mount_slots,tol)
faces=rg.Brep.CreatePlanarBreps(final,tol);assert faces and len(faces)==1 and faces[0].IsValid
removed=rg.AreaMassProperties.Compute(pre_faces[0]).Area-rg.AreaMassProperties.Compute(faces[0]).Area
assert abs(removed-2*(math.pi*(hole_d/2)**2+adjust*hole_d))<tol,'Switch slots collide with a bracket edge or nut pocket'
# Verify actual slot ligaments against original bracket outline and T-slots.
slot_clearances=[]
for x in mount_centers:
 edge_dist=[]
 for e in pre_faces[0].Edges:
  # Sampled slot-boundary clearance for a supplementary support check.
  for q in range(73):
   c=mount_slots[len(slot_clearances)];p=c.PointAt(c.Domain.ParameterAt(q/72.0));ok,u=e.ClosestPoint(p);assert ok
   edge_dist.append(p.DistanceTo(e.PointAt(u)))
 slot_clearances.append(min(edge_dist))
assert min(slot_clearances)>.5,'Switch slot too close to bracket boundary'
BracketEdges=[place(loop.To3dCurve(),(0,y_front,0),(1,0,0),(0,0,1)) for loop in faces[0].Loops]
Direction=rg.Vector3d(0,t,0)
LeftInterfaceCuts=[local(ScrewHole,yc,z_left,(1,0),(0,1))]+[local(a,yc,z_left,(0,1),(1,0)) for a in ReceiverSlots]
BottomInterfaceCuts=[local(ScrewHole,x_bottom,yc,(1,0),(0,1))]+[local(a,x_bottom,yc,(1,0),(0,1)) for a in ReceiverSlots]
# Separate preview hardware for exactly TWO bracket attachment joints.
Screws=[];Nuts=[];joints=[]
def cylinder(p,axis,r,h):return rg.Cylinder(rg.Circle(rg.Plane(p,axis),r),h).ToBrep(True,True)
def hardware(receiver,p,axis,tangent):
 p=rg.Point3d(*p);a=rg.Vector3d(*axis);u=rg.Vector3d(*tangent);n=rg.Vector3d.CrossProduct(a,u);n.Unitize()
 seat=p+a*(t+s['seat']);length=t+s['seat']+s['nt']/2+.5
 Screws.extend([cylinder(p,a,s['bolt']/2,length),cylinder(p-a*s['bolt'],a,s['af']/2,s['bolt'])])
 q=seat-a*s['nt']/2
 pts=[q+u*(rnut*math.cos(math.radians(30+60*i)))+n*(rnut*math.sin(math.radians(30+60*i))) for i in range(6)];pts.append(pts[0])
 hf=rg.Brep.CreatePlanarBreps([rg.PolylineCurve(pts),rg.Circle(rg.Plane(q,a),s['bolt']/2).ToNurbsCurve()],tol)[0]
 nut=hf.Faces[0].CreateExtrusion(rg.LineCurve(q,q+a*s['nt']),True)
 if nut.SolidOrientation==rg.BrepSolidOrientation.Inward:nut.Flip()
 Nuts.append(nut)
 entry=p+a*t/2;joints.append(dict(receiver=receiver,entry=[entry.X,entry.Y,entry.Z],seat=[seat.X,seat.Y,seat.Z],axis=list(axis),tangent=list(tangent)))
hardware('Left',(0,yc,z_left),(1,0,0),(0,0,1))
hardware('Bottom',(x_bottom,yc,s['rim']),(0,0,1),(1,0,0))
# Approximate KW11 body with supplied 9.5 mm pitch, not a certified vendor model.
body_l=19.8;body_h=10.2;body_d=6.4
body_x0=mount_x-body_l/2;body_x1=mount_x+body_l/2
body_z0=mount_z-body_h/2;body_z1=mount_z+body_h/2
# Rear-face mounting: the body starts at the bracket rear face and extends toward the Divider.
body_y0=y_rear
body_y1=body_y0+body_d
assert body_x0>t+.5 and body_y0>0 and body_y1<F and body_z0>floor and body_z1<top
body_profile=rectangle(body_x0,body_z0,body_x1,body_z1)
body_holes=[rg.Circle(rg.Point3d(x,mount_z,0),hole_d/2).ToNurbsCurve() for x in mount_centers]
def prism(curves,y,depth):
 cs=[place(c,(0,y,0),(1,0,0),(0,0,1)) for c in curves]
 fs=rg.Brep.CreatePlanarBreps(cs,tol);assert fs and len(fs)==1
 return fs[0].Faces[0].CreateExtrusion(rg.LineCurve(rg.Point3d(0,y,0),rg.Point3d(0,y+depth,0)),True)
SwitchBody=prism([body_profile]+body_holes,body_y0,body_d)
# Rear-mounted preview: mirror the former front-side assembly in Y while retaining
# the mounting-hole X/Z centerline and exact world-space roller actuation point.
roller_r=2.5;roller_width=3.0
roller_x=body_x1+4.1;roller_y=body_y1+1.8;roller_z=2*mount_z-(body_z1+1.2)
pivot=rg.Point3d(body_x0+2.0,body_y0+body_d*.45,2*mount_z-(body_z1+.35))
tip=rg.Point3d(roller_x,roller_y,roller_z)
v=tip-pivot;v.Unitize();u=rg.Vector3d.CrossProduct(rg.Vector3d.ZAxis,v);u.Unitize();n=rg.Vector3d.CrossProduct(v,u);n.Unitize()
lever_plane=rg.Plane(pivot,u,n)
Lever=[rg.Box(lever_plane,rg.Interval(-.9,.9),rg.Interval(-.25,.25),rg.Interval(0,pivot.DistanceTo(tip))).ToBrep()]
Roller=cylinder(rg.Point3d(roller_x,roller_y-roller_width/2,roller_z),rg.Vector3d.YAxis,roller_r,roller_width)
# Small pivot reference entirely above the body, not fastening hardware.
Lever.append(cylinder(rg.Point3d(pivot.X,pivot.Y-1,pivot.Z),rg.Vector3d.YAxis,1.0,2.0))
reference=[SwitchBody]+Lever+[Roller]
front_space=min(b.GetBoundingBox(True).Min.Y for b in reference+Screws+Nuts)
assert front_space>0 and roller_x+roller_r<W-t and roller_z+roller_r<top
Metadata=json.dumps(dict(t=t,W=W,H=H,D=D,F=F,floor=floor,upper=top,left=left,base=base,height=height,requested_offset=requested_offset,offset=effective_offset,y_front=y_front,y_rear=y_rear,joints=joints,mount_pitch=pitch,mount_height=mount_height,mount_z=mount_z,mount_centers=mount_centers,mount_diameter=hole_d,adjustment=adjust,slot_clearances=slot_clearances,body_x_range=[body_x0,body_x1],body_y_range=[body_y0,body_y1],body_z_range=[body_z0,body_z1],pivot=[pivot.X,pivot.Y,pivot.Z],roller_center=[roller_x,roller_y,roller_z],roller_radius=roller_r,front_space=front_space,guide_clear_height=roller_z-roller_r-floor))
Report='BRACKET | one %.3f mm sheet, body %.3f x %.3f mm\nFront face Y=%.3f; rear face Y=%.3f; divider front Y=%.3f; offset %.3f mm (requested %.3f)\nLower corner X=%.3f, Z=%.3f\nLeft: 1 M3 joint | Bottom: 1 M3 joint | total 2\n4 alignment tabs; captive-nut T-slots reuse existing generator\nSwitch: 2 unchanged horizontal slots, diameter %.3f, overall length %.3f\nPitch %.3f mm; hole axis %.3f mm above Bottom upper face\nShared horizontal adjustment: %.3f mm TOTAL (+/- %.3f)\nKW11 body Y=%.3f..%.3f on REAR / Divider side of bracket\nRoller center fixed at X=%.3f Y=%.3f Z=%.3f; diameter %.3f; axis Y\nClear vertical height to roller underside %.3f mm\nNo guide-tube hole.'%(t,base,height,y_front,y_rear,F,effective_offset,requested_offset,left,floor,hole_d,hole_d+adjust,pitch,mount_height,adjust,adjust/2,body_y0,body_y1,roller_x,roller_y,roller_z,2*roller_r,roller_z-roller_r-floor)
# ---------- end py3_3 ----------
panel_4 = Panel(py3_3.Report)
boundary = BoundarySurfaces(Edges=py3_3.BracketEdges)
extr = Extrude(Base=boundary, Direction=py3_3.Direction)
cap = CapHoles(Brep=extr)
preview = CustomPreview(Geometry=cap, Material=ColourSwatch(SwatchColor=RGB(207, 126, 72)))
preview_2 = CustomPreview(Geometry=py3_3.SwitchBody, Material=ColourSwatch(SwatchColor=RGB(64, 69, 74)))
preview_3 = CustomPreview(Geometry=py3_3.Lever, Material=ColourSwatch(SwatchColor=RGB(170, 180, 190)))
preview_4 = CustomPreview(Geometry=py3_3.Roller, Material=ColourSwatch(SwatchColor=RGB(190, 74, 65)))

# ---- group: 04 — Main Panels
py3_4 = Python3Script(
    Spec=py3.Spec,
    BoxWidth=number_slider,
    BoxHeight=number_slider_2,
    BoxDepth=number_slider_3,
    DividerOffsetFromFront=number_slider_4,
    TSlot=py3.TSlot,
    Tabs=py3.Tabs,
    ReceiverSlots=py3.ReceiverSlots,
    ScrewHole=py3.ScrewHole,
    TopBottomSlots=py3_2.TopBottomSlots,
    SideSlots=py3_2.SideSlots,
    TopMountHoleDiameter=number_slider_10,
    OS20GridPitch=number_slider_11,
    ExtraMountHoles=toggle,
    BracketLeftCuts=py3_3.LeftInterfaceCuts,
    BracketBottomCuts=py3_3.BottomInterfaceCuts,
    UpperJointOffsetZ=number_slider_9)  # -> out, TopEdges, BottomEdges, LeftEdges, RightEdges, Vertical, Across, KerfCenterlines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; inputs Tabs: list, ReceiverSlots: list, TopBottomSlots: list, SideSlots: list, BracketLeftCuts: list, BracketBottomCuts: list
# ---------- py3_4: Python ----------
"""Apply shared MakerCase joint templates; construct four external profiles.
XY panel-local region operations preserve editable planar laser-cut parts.
Top/Bottom bodies sit BETWEEN sides. Their tabs alone reach exterior X.
Front AND rear remain open. No rear cap or rear-cap-only joint features.
Upper side edges meet Top; upper nuts engage its cutouts from below.
No screws or nut pockets belong to the unchanged internal divider.
Four center-origin OS20 M4 holes and an optional pair are subtracted ONLY from Top.
"""
import Rhino.Geometry as rg
import json, math
s=json.loads(str(Spec)); t=s['t']; c=s['fit']; k=s['kerf']; rim=s['rim']
W,H,D,F=[float(v) for v in (BoxWidth,BoxHeight,BoxDepth,DividerOffsetFromFront)]
tol=0.001

def unwrap(v):
 import rhinoscriptsyntax as rs
 if hasattr(v,'Value'): v=v.Value
 return v if isinstance(v,rg.Curve) else rs.coercecurve(v)
TSlot=unwrap(TSlot); ScrewHole=unwrap(ScrewHole)
Tabs=[unwrap(v) for v in Tabs]; ReceiverSlots=[unwrap(v) for v in ReceiverSlots]
TopBottomSlots=[unwrap(v) for v in TopBottomSlots]; SideSlots=[unwrap(v) for v in SideSlots]
BracketLeftCuts=[unwrap(v) for v in BracketLeftCuts]
BracketBottomCuts=[unwrap(v) for v in BracketBottomCuts]
def rect(a,b,c,d):
 return rg.PolylineCurve([rg.Point3d(a,b,0),rg.Point3d(c,b,0),rg.Point3d(c,d,0),rg.Point3d(a,d,0),rg.Point3d(a,b,0)])
def place(crv,origin,u,v):
 p=rg.Plane(rg.Point3d(*origin),rg.Vector3d(*u),rg.Vector3d(*v))
 x=rg.Transform.PlaneToPlane(rg.Plane.WorldXY,p)
 a=crv.DuplicateCurve(); a.Transform(x); return a
def local(crv,x,y,u,v): return place(crv,(x,y,0),(u[0],u[1],0),(v[0],v[1],0))

def finish(base,tabs,cuts,name):
 union=rg.Curve.CreateBooleanUnion([base]+tabs,tol)
 assert union and len(union)==1, name+': disconnected outer boundary'
 # Cut each connected void/notch in succession, preserving any inner loops.
 # Region difference with the complete cutter list returns all final boundaries.
 result=rg.Curve.CreateBooleanDifference(union[0],cuts,tol)
 assert result and len(result)>0, name+': failed region difference'
 faces=rg.Brep.CreatePlanarBreps(result,tol)
 assert faces and len(faces)==1 and faces[0].IsValid, name+': invalid or disconnected panel'
 loops=[loop.To3dCurve() for loop in faces[0].Loops]
 assert all(x.IsClosed and x.IsPlanar(tol) and x.IsValid for x in loops)
 return faces[0],loops

# Front and rear joint stations adapt independently around the divider.
reach=s['pitch']+(s['tab']+c)/2
front=F/2-t
rear=(F+t+D-t)/2
assert front-reach>0.8, 'Front chamber too short for two-tab M3 joints.'
assert front+reach<F-c/2-0.8, 'Front joint collides with divider slots.'
assert rear-reach>F+t+c/2+0.8, 'Rear joint collides with divider slots.'
assert rear+reach<D-t-0.8, 'Rear chamber too short for two-tab M3 joints.'
assert W>2*(t+s['end'])+t, 'Opposing side T-slots need a solid central web.'
assert H>2*(rim+t)+4*t
stations=[front,rear]
zb=rim; zt=H-rim-t
upper_plane=zt+t
open_rear=D-t
# Keep original Top elevation and divider slots. Offset ONLY upper hardware
# axes and their side clearance holes; alignment tabs retain their elevations.
# Hex flats remain parallel to the T-slot's 5.7 mm anti-rotation walls.
nut_radius=s['af']/math.sqrt(3)
upper_clearance=max(s['nut_clear'],0.05)
top_axis_z=upper_plane-max(nut_radius,s['af']/2,s['bolt']/2)+(-upper_clearance)+float(UpperJointOffsetZ)
flat_lo=max(zt,top_axis_z-nut_radius/2)
flat_hi=min(upper_plane,top_axis_z+nut_radius/2)
assert flat_hi-flat_lo>0.5, 'Insufficient Top/nut anti-rotation-flat overlap.'
assert top_axis_z+s['hole']/2<upper_plane-0.5, 'Upper screw hole breaks the ceiling edge.'

bodies={}; profiles={}; cutcenter=[]; joints=[]; screws=[]; nuts=[]
planes={
 'Top':((0,0,zt),(1,0,0),(0,1,0)),
 'Bottom':((0,0,zb),(1,0,0),(0,1,0)),
 'Left':((0,0,0),(0,1,0),(0,0,1)),
 'Right':((W-t,0,0),(0,1,0),(0,0,1))}

# OS20 mount centers are derived from the geometric center of the actual Top.
# No positions are clamped: unsafe settings fail the real-profile clearance checks.
mount_diameter=float(TopMountHoleDiameter); mount_r=mount_diameter/2.0
pitch=float(OS20GridPitch)
toggle=ExtraMountHoles.Value if hasattr(ExtraMountHoles,'Value') else ExtraMountHoles
extra_mount_holes=bool(toggle)
ligament=t
center_x=W/2.0; center_y=open_rear/2.0
assert mount_diameter>0 and pitch>0,'Top mount diameter and OS20 pitch must be positive'

def exact_curve_clearance(a,b):
 ok,p1,p2=a.ClosestPoints(b)
 assert ok,'Failed exact mount-hole/profile distance calculation'
 return p1.DistanceTo(p2)
def curve_clearance(profile,curves):
 if not curves:return 1e9
 return min(exact_curve_clearance(profile,c) for c in curves)
body_edges=[
 rg.LineCurve(rg.Point3d(t,0,0),rg.Point3d(W-t,0,0)),
 rg.LineCurve(rg.Point3d(W-t,0,0),rg.Point3d(W-t,open_rear,0)),
 rg.LineCurve(rg.Point3d(W-t,open_rear,0),rg.Point3d(t,open_rear,0)),
 rg.LineCurve(rg.Point3d(t,open_rear,0),rg.Point3d(t,0,0))]
mount_specs=[('Front Left',-1,-1),('Front Right',1,-1),('Rear Left',-1,1),('Rear Right',1,1)]
mount_rows=[]; mount_circles=[]
for name,sx,sy in mount_specs:
 x=center_x+sx*pitch;y=center_y+sy*pitch
 mount_rows.append(dict(name=name,x=x,y=y,radius=mount_r))
 mount_circles.append(rg.Circle(rg.Point3d(x,y,0),mount_r).ToNurbsCurve())
if extra_mount_holes:
 for name,sx in [('Extra Left',-2),('Extra Right',2)]:
  x=center_x+sx*pitch;y=center_y
  mount_rows.append(dict(name=name,x=x,y=y,radius=mount_r))
  mount_circles.append(rg.Circle(rg.Point3d(x,y,0),mount_r).ToNurbsCurve())
mount_count=len(mount_rows)

for name,z in [('Top',zt),('Bottom',zb)]:
 tabparts=[]; cuts=list(TopBottomSlots)
 for x,iv in [(t,(1,0)),(W-t,(-1,0))]:
  for y in stations:
   tabparts += [local(a,x,y,(0,1),iv) for a in Tabs]
   cuts.append(local(TSlot,x,y,(0,1),iv))
 if name=='Top':
  # Measure each exact finished-size circle against the actual Top profile,
  # side T-slot curves, Divider-slot curves, nominal body edges and other holes.
  uncut,uncut_edges=finish(rect(t,0,W-t,open_rear),tabparts,cuts,'Top before M4 mounts')
  outer=[loop.To3dCurve() for loop in uncut.Loops if loop.LoopType==rg.BrepLoopType.Outer]
  tslot_cuts=cuts[len(TopBottomSlots):]
  for i,record in enumerate(mount_rows):
   x=record['x'];y=record['y'];point=rg.Point3d(x,y,0);circle=mount_circles[i]
   assert any(crv.Contains(point,rg.Plane.WorldXY,tol)==rg.PointContainment.Inside for crv in outer),'Mount hole center outside Top'
   record['panel_outline_clearance']=curve_clearance(circle,outer)
   record['body_edge_clearance']=curve_clearance(circle,body_edges)
   record['tslot_clearance']=curve_clearance(circle,tslot_cuts)
   record['divider_slot_clearance']=curve_clearance(circle,TopBottomSlots)
   others=[c for j,c in enumerate(mount_circles) if j!=i]
   record['other_mount_clearance']=curve_clearance(circle,others)
   record['minimum_feature_clearance']=min(record['panel_outline_clearance'],record['body_edge_clearance'],record['tslot_clearance'],record['divider_slot_clearance'])
   record['inside_material']=min(record['minimum_feature_clearance'],record['other_mount_clearance'])>=ligament-tol
   assert record['inside_material'], 'Unsafe OS20 M4 mount: '+record['name']+' | minimum ligament %.3f mm'%min(record['minimum_feature_clearance'],record['other_mount_clearance'])
  cuts+=mount_circles
 if name=='Bottom':
  before_bracket=finish(rect(t,0,W-t,open_rear),tabparts,cuts,'Bottom before bracket')[0]
  cuts+=BracketBottomCuts
 bodies[name],profiles[name]=finish(rect(t,0,W-t,open_rear),tabparts,cuts,name)
 if name=='Bottom':
  removed=rg.AreaMassProperties.Compute(before_bracket).Area-rg.AreaMassProperties.Compute(bodies[name]).Area
  expected=sum(abs(rg.AreaMassProperties.Compute(a).Area) for a in BracketBottomCuts)
  assert abs(removed-expected)<tol,'Bracket Bottom interfaces overlap an existing joint, divider slot or edge'
 if name=='Top':
  area_removed=rg.AreaMassProperties.Compute(uncut).Area-rg.AreaMassProperties.Compute(bodies[name]).Area
  assert abs(area_removed-mount_count*math.pi*mount_r**2)<tol, 'OS20 M4 mount holes overlap existing voids or each other'
for name in ['Left','Right']:
 cuts=list(SideSlots)
 for tab_z,screw_z in [(zb+t/2,zb+t/2),(zt+t/2,top_axis_z)]:
  for y in stations:
   cuts.append(local(ScrewHole,y,screw_z,(1,0),(0,1)))
   cuts += [local(a,y,tab_z,(1,0),(0,1)) for a in ReceiverSlots]
 if name=='Left':
  before_bracket=finish(rect(0,0,open_rear,upper_plane),[],cuts,'Left before bracket')[0]
  cuts+=BracketLeftCuts
 bodies[name],profiles[name]=finish(rect(0,0,open_rear,upper_plane),[],cuts,name)
 if name=='Left':
  removed=rg.AreaMassProperties.Compute(before_bracket).Area-rg.AreaMassProperties.Compute(bodies[name]).Area
  expected=sum(abs(rg.AreaMassProperties.Compute(a).Area) for a in BracketLeftCuts)
  assert abs(removed-expected)<tol,'Bracket Left interfaces overlap an existing joint, divider slot or edge'

# In-place kerf centerlines: not nested, labelled, baked, or exported.
# Nominal finished solids remain exact. Outer contours grow K/2 into waste;
# void contours shrink K/2. This avoids double compensation of fit allowances.
for name in ['Top','Bottom','Left','Right']:
 origin,u,v=planes[name]
 for loop in bodies[name].Loops:
  curve=loop.To3dCurve(); outer=loop.LoopType==rg.BrepLoopType.Outer
  if k>0:
   area=abs(rg.AreaMassProperties.Compute(curve).Area); found=None
   for distance in [k/2,-k/2]:
    offsets=curve.Offset(rg.Plane.WorldXY,distance,tol,rg.CurveOffsetCornerStyle.Sharp)
    if offsets and len(offsets)==1 and offsets[0].IsClosed:
     aa=abs(rg.AreaMassProperties.Compute(offsets[0]).Area)
     if (aa>area)==outer: found=offsets[0]; break
   assert found is not None, name+': kerf offset failed'
   curve=found
  cutcenter.append(place(curve,origin,u,v))
 profiles[name]=[place(a,origin,u,v) for a in profiles[name]]

# Hardware is separate, OPTIONAL preview geometry, never part of a sheet part.
def cylinder(origin,axis,radius,height):
 return rg.Cylinder(rg.Circle(rg.Plane(origin,axis),radius),height).ToBrep(True,True)
def hardware(receiver,sender,p,axis,tangent):
 p=rg.Point3d(*p); a=rg.Vector3d(*axis); u=rg.Vector3d(*tangent)
 n=rg.Vector3d.CrossProduct(a,u); n.Unitize()
 seat=p+a*(t+s['seat'])
 length=t+s['seat']+s['nt']/2+0.5
 screws.extend([cylinder(p,a,s['bolt']/2,length),cylinder(p-a*s['bolt'],a,s['af']/2,s['bolt'])])
 r=s['af']/math.sqrt(3); q=seat-a*s['nt']/2
 pts=[q+u*(r*math.cos(math.radians(30+60*i)))+n*(r*math.sin(math.radians(30+60*i))) for i in range(6)]
 pts.append(pts[0]); hexcurve=rg.PolylineCurve(pts)
 face=rg.Brep.CreatePlanarBreps([hexcurve,rg.Circle(rg.Plane(q,a),s['bolt']/2).ToNurbsCurve()],tol)[0]
 nut=face.Faces[0].CreateExtrusion(rg.LineCurve(q,q+a*s['nt']),True)
 nuts.append(nut)
 entry=p+a*t/2
 joints.append(dict(receiver=receiver,sender=sender,entry=[entry.X,entry.Y,entry.Z],seat=[seat.X,seat.Y,seat.Z],axis=list(axis),tangent=list(tangent)))
for sender,z in [('Bottom',zb+t/2),('Top',top_axis_z)]:
 for y in stations:
  hardware('Left',sender,(0,y,z),(1,0,0),(0,1,0))
  hardware('Right',sender,(W,y,z),(-1,0,0),(0,1,0))
TopEdges=profiles['Top']; BottomEdges=profiles['Bottom']; LeftEdges=profiles['Left']; RightEdges=profiles['Right']
Vertical=rg.Vector3d(0,0,t); Across=rg.Vector3d(t,0,0)
KerfCenterlines=cutcenter
Screws=screws; Nuts=nuts
min_hole_hole=min(r['other_mount_clearance'] for r in mount_rows)
min_hole_feature=min(r['minimum_feature_clearance'] for r in mount_rows)
mount_data=dict(profile='M4 circular through-hole',diameter=mount_diameter,hole_count=mount_count,minimum_ligament=ligament,center_x=center_x,center_y=center_y,grid_pitch=pitch,primary_half_span=pitch,extra_half_span=2*pitch,extra_enabled=extra_mount_holes,holes=mount_rows,minimum_hole_hole_clearance=min_hole_hole,minimum_hole_feature_clearance=min_hole_feature,adjusted=False)
Metadata=json.dumps(dict(spec=s,W=W,H=H,D=D,F=F,zb=zb,zt=zt,upper_plane=upper_plane,open_rear=open_rear,top_axis_z=top_axis_z,upper_joint_offset_z=float(UpperJointOffsetZ),flat_probe_z=(flat_lo+flat_hi)/2,flat_overlap=flat_hi-flat_lo,upper_clearance=upper_clearance,joints=joints,ceiling_mount=mount_data,profile_counts={name:len(profiles[name]) for name in profiles}))
MountReport='%d TOP M4 THROUGH-HOLES | diameter %.3f mm | OS20 pitch %.3f mm\nTop geometric center = (%.3f, %.3f) mm | primary pattern = %.3f x %.3f mm\nExtraMountHoles = %s | positions are grid-derived and are not clamped.\nMinimum required material ligament = %.3f mm. All values below are exact hole-edge to feature-edge clearances.\n'%(mount_count,mount_diameter,pitch,center_x,center_y,2*pitch,2*pitch,str(extra_mount_holes),ligament)
for r in mount_rows:
 MountReport+='%s | X %.3f Y %.3f | outer %.3f | body edge %.3f | T-slot %.3f | Divider slot %.3f | other mount %.3f | minimum feature %.3f | valid %s\n'%(r['name'],r['x'],r['y'],r['panel_outline_clearance'],r['body_edge_clearance'],r['tslot_clearance'],r['divider_slot_clearance'],r['other_mount_clearance'],r['minimum_feature_clearance'],str(r['inside_material']))
MountReport+='MINIMUM HOLE-TO-HOLE EDGE CLEARANCE = %.3f mm\nMINIMUM HOLE-TO-FEATURE EDGE CLEARANCE = %.3f mm'%(min_hole_hole,min_hole_feature)
Architecture='5 SHEET PARTS | OPEN FRONT AND REAR\nX = width | Y = front to rear | Z = height\nFront Y=0; open rear Y=%.3f\nTop/Bottom bodies X=T .. W-T; alignment tabs enter sides\nBottom Z: %.3f..%.3f; Top Z: %.3f..%.3f\nTop / Left / Right upper plane Z = %.3f\nUpper screw/nut axis Z = %.3f (offset +%.3f)\nExpected captive-nut protrusion above Top = %.3f\nLeft/Right: 4 screw holes each, NO nut pockets\nTop/Bottom: 4 edge-on captive-nut T-slots each\n8 mechanical joints; 16 external alignment tabs\nDivider unchanged: Y=%.3f, tabs only\nOriginal H/D sliders retained as reference dimensions; resulting sheet envelope W x (H-rim) x (D-T).'%(open_rear,zb,zb+t,zt,zt+t,upper_plane,top_axis_z,float(UpperJointOffsetZ),max(0.0,top_axis_z+nut_radius-upper_plane),F)
# ---------- end py3_4 ----------
panel_5 = Panel(py3_4.Architecture)
boundary_2 = BoundarySurfaces(Edges=py3_4.TopEdges)
boundary_3 = BoundarySurfaces(Edges=py3_4.LeftEdges)
extr_2 = Extrude(Base=boundary_2, Direction=py3_4.Vertical)
extr_3 = Extrude(Base=boundary_3, Direction=py3_4.Across)
cap_2 = CapHoles(Brep=extr_2)
cap_3 = CapHoles(Brep=extr_3)

# ---- group: 07 — Top M4 OS20 Mounts (continued)
panel_6 = Panel(py3_4.MountReport)

# ---- group: 12 — Right PCB-Anchored Universal Mounting Plate
py3_5 = Python3Script(
    PanelMetadata=py3_4.Metadata,
    BaseRightEdges=py3_4.RightEdges,
    PCBGridInsetLeft=Slider(8.5, range=4.6..12.4),
    PCBGridInsetTop=Slider(7.138055, range=4.6..12.4),
    OS20GridPitch=number_slider_11,
    RightMountHoleDiameter=Slider(3.2, range=2.8..4),
    EnableR1C2=Toggle(True),
    EnableR2C1=Toggle(True),
    EnableR2C3=Toggle(True),
    EnableR3C1=Toggle(True),
    EnableR3C3=Toggle(True),
    EnableR4C2=Toggle(True))  # -> out, RightEdges, MountKerfCenterlines, PanelMetadataOut, Metadata, Report, StrictValid, ApprovedValid, out_2; inputs BaseRightEdges: list
# ---------- py3_5: Python ----------
"""Focused Right-only PCB-anchored OS20 mounting stage.
Base profiles are preserved; only approved mounting circles and their laser paths are appended.
The standard 3 mm rule is NOT relaxed. Four named PCB positions have an explicit non-overlap-only exception.
"""
import Rhino.Geometry as rg
import rhinoscriptsyntax as rs
import Grasshopper as gh
import json, math
m=json.loads(str(PanelMetadata));s=m['spec'];tol=0.001;ligament=3.0
radius=float(RightMountHoleDiameter)/2.0;kerf=float(s['kerf']);pitch=float(OS20GridPitch)
left=float(PCBGridInsetLeft);top=float(PCBGridInsetTop)
assert radius>0 and pitch>0 and 2*radius>kerf,'Invalid Right diameter, pitch or kerf'
assert abs(float(m['ceiling_mount']['minimum_ligament'])-ligament)<tol,'Existing minimum-ligament policy changed'
def unwrap(v):
 if hasattr(v,'Value'):v=v.Value
 return v if isinstance(v,rg.Curve) else rs.coercecurve(v)
base=[unwrap(v) for v in BaseRightEdges]
assert len(base)==11 and all(c and c.IsValid and c.IsClosed for c in base),'Unexpected base Right fabrication profiles'
x=m['W']-s['t'];height=m['upper_plane']
plane=rg.Plane(rg.Point3d(x,0,0),rg.Vector3d.YAxis,rg.Vector3d.ZAxis)
def enabled(v):return bool(v.Value if hasattr(v,'Value') else v)
controls={'R1C2':enabled(EnableR1C2),'R2C1':enabled(EnableR2C1),'R2C3':enabled(EnableR2C3),'R3C1':enabled(EnableR3C1),'R3C3':enabled(EnableR3C3),'R4C2':enabled(EnableR4C2)}
pcb_ids={'R1C1','R1C3','R4C1','R4C3'};omitted_ids={'R2C2','R3C2'}
feature_names=['outer contour / upper notches','lower Divider slot','upper Divider slot','lower front screw hole','lower tab slot 1','lower tab slot 2','lower rear screw hole','lower tab slot 3','lower tab slot 4','upper front screw hole','upper rear screw hole']
rows=[]
for j in range(4):
 for i in range(3):
  id='R%dC%d'%(j+1,i+1);u=left+i*pitch;v=top+j*pitch;z=height-v;point=rg.Point3d(x,u,z)
  distances=[]
  for idx,curve in enumerate(base):
   ok,parameter=curve.ClosestPoint(point);assert ok,'Failed exact Right profile distance'
   d=point.DistanceTo(curve.PointAt(parameter));inside=curve.Contains(point,plane,1e-7)
   if (idx==0 and inside!=rg.PointContainment.Inside) or (idx>0 and inside==rg.PointContainment.Inside):d=-d
   distances.append(d-radius)
  minimum=min(distances);idx=distances.index(minimum)
  active=id in pcb_ids or controls.get(id,False)
  classification='OMITTED - Divider conflict' if id in omitted_ids else ('DISABLED' if not active else ('PCB EXCEPTION — positive clearance below 3 mm' if id in pcb_ids and minimum<ligament else 'PASS'))
  rows.append(dict(id=id,pcb=id in pcb_ids,enabled=active,omitted=id in omitted_ids,u=u,v=v,x=x,y=u,z=z,radius=radius,minimum_feature_clearance=minimum,limiting_feature=feature_names[idx],feature_clearances=distances,classification=classification))
holes=[r for r in rows if r['enabled']]
assert len([r for r in holes if r['pcb']])==4,'Four PCB references must remain requested'
for row in holes:
 assert row['minimum_feature_clearance']>1e-7,'Actual overlap is never covered by a PCB exception: '+row['id']
 if not row['pcb']:assert row['minimum_feature_clearance']>=ligament-tol,'Universal hole violates 3 mm policy: '+row['id']
 others=[r for r in holes if r['id']!=row['id']]
 row['other_mount_clearance']=min(math.hypot(row['u']-r['u'],row['v']-r['v'])-2*radius for r in others)
 assert row['other_mount_clearance']>=ligament-tol,'New mounting holes violate mutual 3 mm clearance: '+row['id']
mounts=[];paths=[]
for row in holes:
 p=rg.Plane(rg.Point3d(x,row['y'],row['z']),rg.Vector3d.YAxis,rg.Vector3d.ZAxis)
 mounts.append(rg.Circle(p,radius).ToNurbsCurve())
 paths.append(rg.Circle(p,radius-kerf/2.0).ToNurbsCurve())
RightEdges=[c.DuplicateCurve() for c in base]+mounts
before=rg.Brep.CreatePlanarBreps(base,tol);after=rg.Brep.CreatePlanarBreps(RightEdges,tol)
assert before and len(before)==1 and after and len(after)==1 and after[0].IsValid,'Right fabrication profile disconnected or invalid'
removed=rg.AreaMassProperties.Compute(before[0]).Area-rg.AreaMassProperties.Compute(after[0]).Area
assert abs(removed-len(holes)*math.pi*radius*radius)<tol,'Right mounting circles overlap existing voids or each other'
assert len(RightEdges)==len(base)+len(holes),'Unexpected Right profile count'
MountKerfCenterlines=paths
StrictValid=all(r['minimum_feature_clearance']>=ligament-tol for r in holes)
ApprovedValid=True
exception_rows=[r for r in holes if r['classification'].startswith('PCB EXCEPTION')]
universal_rows=[r for r in holes if not r['pcb']]
mount_data=dict(diameter=2*radius,kerf_centerline_diameter=2*radius-kerf,grid_pitch=pitch,inset_left=left,inset_top=top,minimum_ligament=ligament,approved_exception_ids=sorted(pcb_ids),hole_count=len(holes),pcb_count=4,universal_count=len(universal_rows),base_profile_count=len(base),profile_count=len(RightEdges),candidates=rows,holes=holes,strict_valid=StrictValid,approved_valid=ApprovedValid,exception_count=len(exception_rows),minimum_universal_clearance=min((r['minimum_feature_clearance'] for r in universal_rows),default=None),minimum_other_mount_clearance=min(r['other_mount_clearance'] for r in holes),hardware_approved=False)
m['right_mount']=mount_data;m['profile_counts']['Right']=len(RightEdges)
PanelMetadataOut=json.dumps(m)
Metadata=json.dumps(mount_data)
lines=['RIGHT MOUNTING PLATE | %d through-holes | finished diameter %.6f mm | laser centerline diameter %.6f mm'%(len(holes),2*radius,2*radius-kerf),'STANDARD MINIMUM LIGAMENT = 3.000 mm | StrictValid=%s | ApprovedValid=%s'%(StrictValid,ApprovedValid),'PCB exceptions approved for four named positions only; geometric overlap remains prohibited.']
for r in rows:
 lines.append('%s | %s | U %.6f V %.6f | minimum %.6f mm | %s'%(r['id'],r['classification'],r['u'],r['v'],r['minimum_feature_clearance'],r['limiting_feature']))
 for_exception=r['classification'].startswith('PCB EXCEPTION')
 if for_exception:ghenv.Component.AddRuntimeMessage(gh.Kernel.GH_RuntimeMessageLevel.Warning,'%s | %s | actual minimum ligament %.6f mm'%(r['id'],r['classification'],r['minimum_feature_clearance']))
hardware_warning='HARDWARE REVIEW: upper PCB Ø5.5 heads have ~0.015 mm projected enclosure-head gap; middle-column interior fasteners/standoffs may interfere with Divider. Bare-hole validation is not structural or access approval.'
lines.append(hardware_warning)
ghenv.Component.AddRuntimeMessage(gh.Kernel.GH_RuntimeMessageLevel.Warning,hardware_warning)
Report='\n'.join(lines)
# ---------- end py3_5 ----------
panel_7 = Panel(py3_5.Report)

# ---- group: 04 — Main Panels (continued)
boundary_4 = BoundarySurfaces(Edges=py3_5.RightEdges)
extr_4 = Extrude(Base=boundary_4, Direction=py3_4.Across)
cap_4 = CapHoles(Brep=extr_4)

# ---- group: 10 — Guide Pulley Mounting Hole
number_slider_14 = Slider(30, range=10..90)

# ---- group: 11 — Bottom Guide Hole
py3_6 = Python3Script(
    Spec=py3.Spec,
    BottomEdges=py3_4.BottomEdges,
    PanelMetadata=py3_4.Metadata,
    Bracket=cap,
    BracketMetadata=py3_3.Metadata,
    SwitchReference=[py3_3.Lever, py3_3.Roller],
    ExistingHardware=[py3_4.Screws, py3_4.Nuts, py3_3.Screws, py3_3.Nuts],
    GuidePulleyPositionXLimit=number_slider_14,
    BottomGuideHolePositionX=Slider(24, range=5..95),
    BottomGuideHolePositionY=Slider(23, range=5..29),
    BottomGuideHoleSize=Slider(6, range=4..12))  # -> out, BottomEdgesOut, GuideKerfCenterline, Centerline, CenterMarker, PatternValid, Metadata, Report, out_2; inputs BottomEdges: list, SwitchReference: tree, ExistingHardware: tree
# ---------- py3_6: Python ----------
"""One parametric square Bottom-panel guide opening and vertical actuation reference line."""
import Rhino.Geometry as rg
import rhinoscriptsyntax as rs
import json,math
s=json.loads(str(Spec));t=float(s['t']);kerf=float(s['kerf']);tol=.001
panel=json.loads(str(PanelMetadata));bracket_meta=json.loads(str(BracketMetadata))
pulley_input=globals().get('GuidePulleyPositionXLimit',globals().get('GuidePulleyMetadata'))
pulley_x=float(pulley_input)
px,py,hole_size=[float(v) for v in (BottomGuideHolePositionX,BottomGuideHolePositionY,BottomGuideHoleSize)]
half=hole_size/2.0;zb=float(panel['zb']);F=float(panel['F'])

def curve(v):
 if hasattr(v,'Value'):v=v.Value
 return v if isinstance(v,rg.Curve) else rs.coercecurve(v)
def brep(v):
 if hasattr(v,'Value'):v=v.Value
 return v if isinstance(v,rg.Brep) else rs.coercebrep(v)
def values(v,coerce):
 if hasattr(v,'Branches'):return [coerce(a) for branch in v.Branches for a in branch]
 try:return [coerce(a) for a in v]
 except TypeError:return [coerce(v)]
def local(crv):
 c=curve(crv).DuplicateCurve();c.Transform(rg.Transform.Translation(0,0,-zb));return c
def world(crv):
 c=crv.DuplicateCurve();c.Transform(rg.Transform.Translation(0,0,zb));return c
def square_profile(cx,cy,size):
 h=size/2.0
 pts=[rg.Point3d(cx-h,cy-h,0),rg.Point3d(cx+h,cy-h,0),rg.Point3d(cx+h,cy+h,0),rg.Point3d(cx-h,cy+h,0)]
 pts.append(pts[0]);return rg.PolylineCurve(pts)
def curve_clearance(profile,curves):
 if not curves:return 1e9
 distances=[]
 for c in curves:
  ok,a,b=profile.ClosestPoints(c);assert ok,'Failed exact square-to-curve clearance measurement'
  distances.append(a.DistanceTo(b))
 return min(distances)
def brep_clearance(profile,breps):
 if not breps:return 1e9
 ok,a,b,index=profile.ClosestPoints(breps);assert ok,'Failed exact square-to-hardware clearance measurement'
 return a.DistanceTo(b)
def square_rectangle_clearance(cx,cy,h,x0,x1,y0,y1):
 dx=max(x0-(cx+h),0.0,(cx-h)-x1);dy=max(y0-(cy+h),0.0,(cy-h)-y1)
 return math.sqrt(dx*dx+dy*dy)
def square_circle_clearance(cx,cy,h,cx2,cy2,radius):
 qx=abs(cx2-cx)-h;qy=abs(cy2-cy)-h
 if qx<=0 and qy<=0:distance_to_square_edge=min(-qx,-qy)
 else:distance_to_square_edge=math.sqrt(max(qx,0.0)**2+max(qy,0.0)**2)
 return distance_to_square_edge-radius

base=[local(c) for c in values(BottomEdges,curve)]
outer=max(base,key=lambda c:abs(rg.AreaMassProperties.Compute(c).Area))
inners=[c for c in base if c is not outer]
point=rg.Point3d(px,py,0)
hole=square_profile(px,py,hole_size)
corners=[rg.Point3d(px-half,py-half,0),rg.Point3d(px+half,py-half,0),rg.Point3d(px+half,py+half,0),rg.Point3d(px-half,py+half,0)]
edge_clearance=curve_clearance(hole,[outer])
cut_clearance=curve_clearance(hole,inners) if inners else 1e9
hole_top=hole.DuplicateCurve();hole_top.Transform(rg.Transform.Translation(0,0,zb+t))
br=brep(Bracket);bracket_clearance=brep_clearance(hole_top,[br])
# Exact XY footprint clearance from the square opening to the switch-body bounds.
bx0,bx1=[float(v) for v in bracket_meta['body_x_range']];by0,by1=[float(v) for v in bracket_meta['body_y_range']]
body_clearance=square_rectangle_clearance(px,py,half,bx0,bx1,by0,by1)
hardware=values(ExistingHardware,brep)
hardware_clearance=brep_clearance(hole_top,hardware)
feature_clearance=min(cut_clearance,hardware_clearance)
divider_clearance=F-py-half
references=values(SwitchReference,brep)
# A vertical line reaches the lever/roller region when its XY coordinate lies
# inside the XY footprint of either reference solid.
reaches=False
for b in references:
 bb=b.GetBoundingBox(True)
 if bb.Min.X-tol<=px<=bb.Max.X+tol and bb.Min.Y-tol<=py<=bb.Max.Y+tol:
  reaches=True;break
issues=[]
def require(ok,text):
 if not ok:issues.append(text)
require(hole_size>0,'Bottom guide-hole square side must be positive')
require(abs(abs(rg.AreaMassProperties.Compute(hole).Area)-hole_size*hole_size)<tol,'Bottom guide-hole profile is not the requested square area')
require(outer.Contains(point,rg.Plane.WorldXY,tol)==rg.PointContainment.Inside and all(outer.Contains(c,rg.Plane.WorldXY,tol)==rg.PointContainment.Inside for c in corners),'Bottom guide-hole square is outside Bottom panel')
require(py+half<F-tol,'Bottom guide-hole square is not fully inside the front chamber')
require(px+half<pulley_x-tol,'Bottom guide-hole square is not left of guide-pulley projection')
require(edge_clearance>=t-tol,'Bottom guide-hole is too close to panel edge')
require(feature_clearance>=t-tol,'Bottom guide-hole is too close to a Bottom T-slot or hardware')
require(bracket_clearance>=t-tol,'Bottom guide-hole is too close to microswitch bracket')
require(divider_clearance>=t-tol,'Bottom guide-hole is too close to Divider')
# Informational only after the rear-face switch relocation: preserve the requested
# Bottom hole even when its vertical axis does not intersect the preview footprint.
PatternValid=not issues
candidate=base
if PatternValid:
 result=rg.Curve.CreateBooleanDifference(outer,inners+[hole],tol)
 fs=rg.Brep.CreatePlanarBreps(result,tol) if result else None
 require(fs is not None and len(fs)==1 and fs[0].IsValid,'Bottom guide-hole subtraction invalidates Bottom panel')
 if not issues:
  candidate=[loop.To3dCurve() for loop in fs[0].Loops]
  removed=abs(rg.AreaMassProperties.Compute(outer).Area)-rg.AreaMassProperties.Compute(fs[0]).Area
  prior=sum(abs(rg.AreaMassProperties.Compute(c).Area) for c in inners)
  require(abs(removed-prior-hole_size*hole_size)<tol,'Bottom square guide-hole overlaps an existing cut or boundary')
PatternValid=not issues
if not PatternValid:candidate=base
BottomEdgesOut=[world(c) for c in candidate]
GuideKerfCenterline=[]
toolpath_size=hole_size-kerf
if PatternValid:
 require(toolpath_size>2*tol,'Kerf compensation collapses Bottom square guide-hole path')
 if toolpath_size>2*tol:GuideKerfCenterline=[world(square_profile(px,py,toolpath_size))]
roller_x,roller_y,roller_z=[float(v) for v in bracket_meta['roller_center']];roller_r=float(bracket_meta['roller_radius'])
roller_dx=roller_x-px;roller_dy=roller_y-py;roller_xy_distance=math.sqrt(roller_dx*roller_dx+roller_dy*roller_dy)
roller_guide_edge_clearance=square_circle_clearance(px,py,half,roller_x,roller_y,roller_r)
Centerline=rg.LineCurve(rg.Point3d(px,py,zb),rg.Point3d(px,py,roller_z+roller_r))
CenterMarker=world(hole)
Metadata=json.dumps(dict(valid=PatternValid,issues=issues,profile='square',x=px,y=py,hole_size=hole_size,profile_bounds=[px-half,px+half,py-half,py+half],toolpath_size=toolpath_size,distance_to_microswitch_body=body_clearance,distance_to_microswitch_bracket=bracket_clearance,distance_to_nearest_bottom_tslot_or_hardware=feature_clearance,distance_to_divider=divider_clearance,distance_to_nearest_panel_edge=edge_clearance,vertical_actuation_line_reaches_microswitch_region=reaches,roller_x_offset=roller_dx,roller_y_offset=roller_dy,roller_xy_distance=roller_xy_distance,roller_guide_edge_clearance=roller_guide_edge_clearance,bottom_z_min=zb,bottom_z_max=zb+t))
Report=('BOTTOM GUIDE-HOLE PROFILE SQUARE | SIDE %.3f mm\nCENTER X=%.3f Y=%.3f mm | BOUNDS X %.3f..%.3f Y %.3f..%.3f mm\nKERF CENTERLINE SQUARE SIDE %.3f mm\nDistance to microswitch-body footprint %.3f mm\nDistance to microswitch bracket %.3f mm\nDistance to nearest Bottom internal cut / hardware %.3f mm\nDistance to Divider %.3f mm\nDistance to nearest Bottom outer profile %.3f mm\nROLLER VS GUIDE-HOLE X OFFSET %.3f mm\nROLLER VS GUIDE-HOLE Y OFFSET %.3f mm\nROLLER VS GUIDE-HOLE CENTER DISTANCE %.3f mm\nSQUARE-EDGE TO ROLLER CLEARANCE %.3f mm\nVERTICAL ACTUATION CENTERLINE REACHES SWITCH REGION: %s\nPATTERN VALID: %s\n' % (hole_size,px,py,px-half,px+half,py-half,py+half,toolpath_size,body_clearance,bracket_clearance,feature_clearance,divider_clearance,edge_clearance,roller_dx,roller_dy,roller_xy_distance,roller_guide_edge_clearance,'YES' if reaches else 'NO','YES' if PatternValid else 'NO'))
if issues:Report+='INVALID REQUEST: original Bottom retained; center marker shows requested position.\n'+'\n'.join(issues)
# ---------- end py3_6 ----------

# ---- group: 04 — Main Panels (continued)
boundary_5 = BoundarySurfaces(Edges=py3_6.BottomEdgesOut)
extr_5 = Extrude(Base=boundary_5, Direction=py3_4.Vertical)
cap_5 = CapHoles(Brep=extr_5)

# ---- group: 09 — 28BYJ-48 Motor Mounting Interface (continued)
py3_7 = Python3Script(
    Spec=py3.Spec,
    BaseDividerEdges=py3_2.DividerEdges,
    BoxWidth=number_slider,
    BoxHeight=number_slider_2,
    BoxDepth=number_slider_3,
    DividerOffsetFromFront=number_slider_4,
    Sheets=[cap_2, cap_5, cap_3, cap_4],
    Bracket=cap,
    SwitchReference=[py3_3.SwitchBody, py3_3.Lever, py3_3.Roller],
    ExistingHardware=[py3_4.Screws, py3_4.Nuts, py3_3.Screws, py3_3.Nuts],
    MotorPositionX=number_slider_12,
    MotorPositionZ=Slider(40, range=28..52),
    MotorRotation=Slider(0, range=0..180))  # -> out, DividerEdges, DividerKerfCenterlines, Body, Flange, Boss, Shaft, Screws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; inputs BaseDividerEdges: list, Sheets: tree, SwitchReference: tree, ExistingHardware: tree
# ---------- py3_7: Python ----------
"""28BYJ-48 technical mounting pattern and assembly preview.
Only MotorPositionX, MotorPositionZ and MotorRotation are placement controls.
Motor dimensions are fixed project-spec constants; all geometry rotates rigidly.
"""
import Rhino.Geometry as rg
import rhinoscriptsyntax as rs
import json,math
s=json.loads(str(Spec));t=s['t'];fit=s['fit'];tol=.001
W,H,D,F=[float(v) for v in (BoxWidth,BoxHeight,BoxDepth,DividerOffsetFromFront)]
x,z,angle=[float(v) for v in (MotorPositionX,MotorPositionZ,MotorRotation)]
# Fixed 28BYJ-48 project specification (mm).
MotorBodyDiameter=28.0
MotorBodyDepth=19.0
MotorMountHoleSpacing=35.0
MotorMountHoleDiameter=4.0
MotorCenterClearanceDiameter=9.0
MotorShaftOffsetX=0.0
MotorShaftOffsetZ=8.0
MotorBossDiameter=9.0
MotorShaftNominalDiameter=5.0
MotorShaftFlatDimension=3.0
MotorShaftFlatLength=6.0
MotorShaftTotalProjection=10.0
MotorFlangeThickness=1.0
MotorEarOuterHeight=7.0
MotorConnectorWidth=14.6
MotorConnectorBottomOffset=17.0
# Preview-only unspecified details retained as internal constants.
MotorBossProjection=2.8
MotorScrewDiameter=3.0
MotorScrewHeadDiameter=7.0
MotorScrewHeadHeight=2.8
MotorScrewOverhang=0.8
cd=MotorCenterClearanceDiameter;hd=MotorMountHoleDiameter;pitch=MotorMountHoleSpacing
offset_x=MotorShaftOffsetX;offset_z=MotorShaftOffsetZ
bd=MotorBodyDiameter;depth=MotorBodyDepth;ft=MotorFlangeThickness;ew=MotorEarOuterHeight
bossd=MotorBossDiameter;bossp=MotorBossProjection;sd=MotorShaftNominalDiameter;sp=MotorShaftTotalProjection
flat_dim=MotorShaftFlatDimension;flat_len=MotorShaftFlatLength;connector_width=MotorConnectorWidth;connector_bottom=MotorConnectorBottomOffset
bolt=MotorScrewDiameter;head_d=MotorScrewHeadDiameter;head_h=MotorScrewHeadHeight;overhang=MotorScrewOverhang
rear=F+t;rear_edge=D-t;upper=H-s['rim'];floor=s['rim']+t

def curve(v):
 if hasattr(v,'Value'):v=v.Value
 return v if isinstance(v,rg.Curve) else rs.coercecurve(v)
def brep(v):
 if hasattr(v,'Value'):v=v.Value
 return v if isinstance(v,rg.Brep) else rs.coercebrep(v)
def flatten(tree):return [brep(v) for branch in tree.Branches for v in branch]
base_world=[curve(v) for v in BaseDividerEdges];bracket=brep(Bracket)
sheets=flatten(Sheets);switch=flatten(SwitchReference);existing=flatten(ExistingHardware)
plane=rg.Plane(rg.Point3d(0,F,0),rg.Vector3d.XAxis,rg.Vector3d.ZAxis)
to2=rg.Transform.PlaneToPlane(plane,rg.Plane.WorldXY);to3=rg.Transform.PlaneToPlane(rg.Plane.WorldXY,plane)
base=[]
for crv in base_world:
 c=crv.DuplicateCurve();c.Transform(to2);base.append(c)
assert len(base)==1,'Expected original divider outer contour only'
outer=base[0]
def rect(x0,z0,x1,z1):return rg.PolylineCurve([rg.Point3d(x0,z0,0),rg.Point3d(x1,z0,0),rg.Point3d(x1,z1,0),rg.Point3d(x0,z1,0),rg.Point3d(x0,z0,0)])
def world(crv,y=F):
 c=crv.DuplicateCurve();p=rg.Plane(rg.Point3d(0,y,0),rg.Vector3d.XAxis,rg.Vector3d.ZAxis);c.Transform(rg.Transform.PlaneToPlane(rg.Plane.WorldXY,p));return c
def solid(curves,y,height):
 cs=[world(c,y) for c in curves];fs=rg.Brep.CreatePlanarBreps(cs,tol)
 assert fs and len(fs)==1
 b=fs[0].Faces[0].CreateExtrusion(rg.LineCurve(rg.Point3d(0,y,0),rg.Point3d(0,y+height,0)),True)
 if b.SolidOrientation==rg.BrepSolidOrientation.Inward:b.Flip()
 return b
def cylinder(cx,cz,y,r,height):
 b=rg.Cylinder(rg.Circle(rg.Plane(rg.Point3d(cx,y,cz),rg.Vector3d.YAxis),r),height).ToBrep(True,True)
 if b.SolidOrientation==rg.BrepSolidOrientation.Inward:b.Flip()
 return b
ca=math.cos(math.radians(angle));sa=math.sin(math.radians(angle))
mount_centers=[(x-pitch/2*ca,z-pitch/2*sa),(x+pitch/2*ca,z+pitch/2*sa)]
shaft_x=x+offset_x*ca-offset_z*sa
shaft_z=z+offset_x*sa+offset_z*ca
records=[dict(name='Center',x=shaft_x,z=shaft_z,radius=cd/2)]+[dict(name='Mount '+str(i+1),x=a,z=b,radius=hd/2) for i,(a,b) in enumerate(mount_centers)]
holes=[rg.Circle(rg.Point3d(r['x'],r['z'],0),r['radius']).ToNurbsCurve() for r in records]
# Recover the eight locating-tab regions by clipping the EXISTING outline.
xl=t+fit/2;xr=W-t-fit/2;zl=floor+fit/2;zh=upper-t-fit/2
tab_regions=[]
for window in [rect(-t,-t,xl,H+t),rect(xr,-t,W+t,H+t),rect(-t,-t,W+t,zl),rect(-t,zh,W+t,H+t)]:
 cs=rg.Curve.CreateBooleanIntersection(outer,window,tol)
 if cs:
  tab_regions.extend(c for c in cs if abs(rg.AreaMassProperties.Compute(c).Area)>tol)
assert len(tab_regions)==8,'Could not identify all eight existing divider tabs'
issues=[]
def require(ok,text):
 if not ok:issues.append(text)
def distance(point,curves,r):
 ds=[]
 for crv in curves:
  ok,u=crv.ClosestPoint(point);assert ok
  ds.append(point.DistanceTo(crv.PointAt(u))-r)
 return min(ds)
for r in records:
 point=rg.Point3d(r['x'],r['z'],0)
 inside=outer.Contains(point,rg.Plane.WorldXY,tol)==rg.PointContainment.Inside
 r['edge_clearance']=distance(point,[outer],r['radius'])
 r['tab_clearance']=distance(point,tab_regions,r['radius'])
 require(inside and r['edge_clearance']>=t-tol,r['name']+' hole has less than one material thickness of divider-edge ligament')
 require(r['tab_clearance']>=t-tol,r['name']+' hole is too close to a locating tab')
 # Exact default-layout distance from the circular aperture at Y=F to the
 # extruded bracket. Its nearest Y face is the bracket rear face.
 by=bracket.GetBoundingBox(True).Max.Y
 q=rg.Point3d(r['x'],by,r['z']);closest=bracket.ClosestPoint(q)
 planar=math.sqrt((closest.X-q.X)**2+(closest.Z-q.Z)**2)
 r['bracket_clearance']=math.sqrt(max(0,planar-r['radius'])**2+(F-by)**2)
for i in range(3):
 for j in range(i+1,3):
  a=records[i];b=records[j];gap=math.hypot(a['x']-b['x'],a['z']-b['z'])-a['radius']-b['radius']
  require(gap>=t-tol,'Motor holes overlap or leave insufficient material between apertures')
require(bossd<=cd+tol,'Output boss preview exceeds the specified central hole')
require(sd<cd-tol,'Shaft preview does not fit the specified central hole')
require(bolt<hd-tol,'Screw preview does not clear motor mount holes')
require(head_d>hd+tol,'Front screw heads do not cover the mounting holes')
require(bossp<=t+tol,'Output boss would project into the front chamber; only shaft may project')
# The cylindrical motor body and mounting-ear midpoint share MotorPosition.
# The boss and shaft remain on the fixed, rotated shaft axis.
Body=cylinder(x,z,rear+ft,bd/2,depth)
p0=rg.Point3d(x,z,0);ps=rg.Point3d(shaft_x,shaft_z,0)
ax=rg.Vector3d(ca,sa,0);ay=rg.Vector3d(-sa,ca,0)
# Preview-only connector housing. Local motor-down rotates with MotorRotation.
connector=rect(-connector_width/2,-connector_bottom,connector_width/2,-bd/2+1.0)
connector.Transform(rg.Transform.PlaneToPlane(rg.Plane.WorldXY,rg.Plane(p0,ax,ay)))
Connector=solid([connector],rear+ft+depth*.40,5.0)
bar=rect(-pitch/2,-ew/2,pitch/2,ew/2);bar.Transform(rg.Transform.PlaneToPlane(rg.Plane.WorldXY,rg.Plane(p0,ax,ay)))
flange_pieces=[rg.Circle(p0,bd/2).ToNurbsCurve(),bar]+[rg.Circle(rg.Point3d(a,b,0),ew/2).ToNurbsCurve() for a,b in mount_centers]
flange_outer=rg.Curve.CreateBooleanUnion(flange_pieces,tol);assert flange_outer and len(flange_outer)==1
flange_cut=rg.Curve.CreateBooleanDifference(flange_outer[0],holes[1:],tol)
Flange=solid(flange_cut,rear,ft)
# Boss remains coaxial with the fixed shaft/clearance axis.
Boss=cylinder(shaft_x,shaft_z,rear-bossp,bossd/2,bossp+ft)
# Double-flat front shaft: 6 mm flattened tip plus a round inboard segment.
shaft_circle=rg.Circle(ps,sd/2).ToNurbsCurve()
shaft_clip=rect(-flat_dim/2,-sd/2,flat_dim/2,sd/2)
shaft_clip.Transform(rg.Transform.PlaneToPlane(rg.Plane.WorldXY,rg.Plane(ps,ax,ay)))
shaft_profiles=rg.Curve.CreateBooleanIntersection(shaft_circle,shaft_clip,tol)
assert shaft_profiles and len(shaft_profiles)==1,'Double-flat shaft profile construction failed'
shaft_tip=rear-sp
flat_shaft=solid([shaft_profiles[0]],shaft_tip,flat_len)
round_shaft=cylinder(shaft_x,shaft_z,shaft_tip+flat_len,sd/2,sp-flat_len+ft)
shaft_union=rg.Brep.CreateBooleanUnion([flat_shaft,round_shaft],tol)
Shaft=shaft_union[0] if shaft_union and len(shaft_union)==1 else flat_shaft
Screws=[]
for a,b in mount_centers:
 Screws.extend([cylinder(a,b,F,bolt/2,t+ft+overhang),cylinder(a,b,F-head_h,head_d/2,head_h)])
MotorBody=[Body,Flange];Output=[Boss,Shaft]
require(Body.GetBoundingBox(True).Min.Y>=rear-tol and Flange.GetBoundingBox(True).Min.Y>=rear-tol,'Motor body/flange not entirely on rear side')
require(Body.GetBoundingBox(True).Max.Y<=rear_edge+tol,'Motor body extends beyond open rear of chamber')
# Check ALL existing solid geometry, including switch and both sets of M3 joints.
def volume_intersection(a,b):
 ab=a.GetBoundingBox(True);bb=b.GetBoundingBox(True)
 if ab.Max.X<bb.Min.X+tol or ab.Min.X>bb.Max.X-tol or ab.Max.Y<bb.Min.Y+tol or ab.Min.Y>bb.Max.Y-tol or ab.Max.Z<bb.Min.Z+tol or ab.Min.Z>bb.Max.Z-tol:return 0.0
 common=rg.Brep.CreateBooleanIntersection(a,b,tol)
 return sum(abs(rg.VolumeMassProperties.Compute(v).Volume) for v in common if v.IsSolid) if common else 0.0
obstacles=[('enclosure panel '+str(i+1),b) for i,b in enumerate(sheets)]+[('microswitch bracket',bracket)]+[('microswitch reference',b) for b in switch]+[('existing hardware',b) for b in existing]
for name,b in [('body',Body),('flange / ears',Flange),('boss',Boss),('shaft',Shaft)]+[('mounting screw',b) for b in Screws]:
 require(b.IsValid and b.IsSolid,'Invalid '+name+' preview solid')
 bb=b.GetBoundingBox(True)
 require(bb.Min.X>=t-tol and bb.Max.X<=W-t+tol and bb.Min.Z>=floor-tol and bb.Max.Z<=upper-t+tol,name+' is outside interior width/height')
 for obstacle,p in obstacles:
  require(volume_intersection(b,p)<.005,name+' collides with '+obstacle)
for b in Screws:require(volume_intersection(b,Body)<.005,'Mounting screw preview intersects cylindrical motor body')
# Keep requested values visible. Never cut an unsafe pattern into the divider.
PatternValid=not issues
candidate_curves=base
if PatternValid:
 result=rg.Curve.CreateBooleanDifference(outer,holes,tol)
 fs=rg.Brep.CreatePlanarBreps(result,tol) if result else None
 require(fs is not None and len(fs)==1 and fs[0].IsValid,'Motor subtraction disconnects or invalidates divider')
 if not issues:
  candidate_curves=[loop.To3dCurve() for loop in fs[0].Loops]
  removed=abs(rg.AreaMassProperties.Compute(outer).Area)-rg.AreaMassProperties.Compute(fs[0]).Area
  require(abs(removed-sum(math.pi*r['radius']**2 for r in records))<tol,'Motor cutouts overlap existing boundaries')
  final_solid=solid(candidate_curves,F,t)
  for name,b in [('motor body',Body),('ears',Flange),('boss',Boss),('shaft',Shaft)]+[('screw',b) for b in Screws]:require(volume_intersection(b,final_solid)<.005,name+' intersects remaining divider material')
PatternValid=not issues
if not PatternValid:candidate_curves=base
DividerEdges=[world(c) for c in candidate_curves]
RequestedPattern=[world(c) for c in holes]
import System.Drawing as drawing
PatternColour=drawing.Color.FromArgb(0,0,0,0) if PatternValid else drawing.Color.FromArgb(255,230,50,40)
# Preserve existing outer kerf compensation and include the 3 new hole paths.
DividerKerfCenterlines=[]
for i,c in enumerate(candidate_curves):
 area=abs(rg.AreaMassProperties.Compute(c).Area)
 isouter=c.Contains(rg.Point3d(t/2,(floor+upper-t)/2,0),rg.Plane.WorldXY,tol)==rg.PointContainment.Inside
 # Outer loop is the largest closed region, independent of orientation/order.
 isouter=abs(area-max(abs(rg.AreaMassProperties.Compute(v).Area) for v in candidate_curves))<tol
 out=c
 if s['kerf']>0:
  found=None
  for off in [s['kerf']/2,-s['kerf']/2]:
   cs=c.Offset(rg.Plane.WorldXY,off,tol,rg.CurveOffsetCornerStyle.Sharp)
   if cs and len(cs)==1 and cs[0].IsClosed:
    aa=abs(rg.AreaMassProperties.Compute(cs[0]).Area)
    if (aa>area)==isouter:found=cs[0];break
  assert found is not None,'Motor/divider kerf offset failed'
  out=found
 DividerKerfCenterlines.append(world(out))
edge=min(r['edge_clearance'] for r in records);tab=min(r['tab_clearance'] for r in records);bracket_gap=min(r['bracket_clearance'] for r in records)
Metadata=json.dumps(dict(valid=PatternValid,applied_holes=3 if PatternValid else 0,issues=issues,x=x,z=z,body_x=x,body_z=z,shaft_x=shaft_x,shaft_z=shaft_z,shaft_offset_x=offset_x,shaft_offset_z=offset_z,connector_direction_x=-sa,connector_direction_z=-ca,rotation=angle,F=F,t=t,W=W,H=H,D=D,center_diameter=cd,mount_diameter=hd,spacing=pitch,records=records,edge_clearance=edge,tab_clearance=tab,bracket_clearance=bracket_gap,body_front=rear,body_rear=rear+ft+depth,shaft_tip=shaft_tip,body_diameter=bd,body_depth=depth,boss_diameter=bossd,shaft_nominal_diameter=sd,shaft_flat_dimension=flat_dim,shaft_flat_length=flat_len,shaft_total_projection=sp,flange_thickness=ft,ear_outer_height=ew,connector_width=connector_width,connector_bottom_offset=connector_bottom))
Report='28BYJ-48 FIXED MOTOR SPEC\nMOUNTING-EAR / BODY CENTER X=%.3f Z=%.3f mm\nSHAFT CENTER X=%.3f Z=%.3f mm\nShaft offset X=%.3f Z=%.3f mm\nMount holes: 2 x %.3f mm; spacing %.3f mm\nBoss / clearance diameter %.3f mm\nShaft nominal / flat / flat length / projection: %.3f / %.3f / %.3f / %.3f mm\nBody: diameter %.3f; depth %.3f mm\nFlange thickness %.3f; ear outer height %.3f mm\nConnector width %.3f; lower extent %.3f mm\nConnector direction X=%.3f Z=%.3f; rotation %.3f degrees\nMinimum aperture-edge clearances: divider edge %.3f; divider tab %.3f; microswitch bracket %.3f mm\nMotor body/flange Y >= %.3f mm (REAR face of divider)\nBody rear Y=%.3f; open rear Y=%.3f\nShaft points -Y; front tip Y=%.3f\nPATTERN VALID = %s\nRequested position is NOT clamped or moved.\n'%(x,z,shaft_x,shaft_z,offset_x,offset_z,hd,pitch,cd,sd,flat_dim,flat_len,sp,bd,depth,ft,ew,connector_width,connector_bottom,-sa,-ca,angle,edge,tab,bracket_gap,rear,rear+ft+depth,rear_edge,shaft_tip,str(PatternValid))
Report+='Dimensions above are fixed project motor-spec constants. Rear ear retention hardware remains schematic.\n'
if issues:Report+='INVALID REQUEST: original uncut divider retained; red curves show requested pattern.\n'+'\n'.join(issues)
# Reuse the existing Body preview output for the can and connector housing.
Body=[Body,Connector]
# ---------- end py3_7 ----------
preview_5 = CustomPreview(Geometry=py3_7.Body, Material=ColourSwatch(SwatchColor=RGB(154, 163, 177)))
preview_6 = CustomPreview(Geometry=py3_7.Flange, Material=ColourSwatch(SwatchColor=RGB(76, 107, 165)))
preview_7 = CustomPreview(Geometry=py3_7.Boss, Material=swatch)
preview_8 = CustomPreview(Geometry=py3_7.Shaft, Material=swatch)
preview_9 = CustomPreview(Geometry=py3_7.RequestedPattern, Material=py3_7.PatternColour)
panel_8 = Panel(py3_7.Report)

# ---- group: 10 — Guide Pulley Mounting Hole (continued)
py3_8 = Python3Script(
    Spec=py3.Spec,
    BaseDividerEdges=py3_2.DividerEdges,
    MotorDividerEdges=py3_7.DividerEdges,
    MotorDividerKerfCenterlines=py3_7.DividerKerfCenterlines,
    MotorMetadata=py3_7.Metadata,
    DividerOffsetFromFront=number_slider_4,
    GuidePulleyPositionX=number_slider_14,
    GuidePulleyPositionZ=Slider(62, range=10..70),
    GuidePulleyHoleDiameter=Slider(3.3, range=3..4))  # -> out, DividerEdges, DividerKerfCenterlines, Pulley, Axis, RequestedHole, PatternValid, Metadata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; inputs MotorDividerEdges: list, MotorDividerKerfCenterlines: list
# ---------- py3_8: Python ----------
"""One parametric M3 guide-pulley hole and front-side reference preview."""
import Rhino.Geometry as rg
import rhinoscriptsyntax as rs
import json,math
s=json.loads(str(Spec));t=float(s['t']);kerf=float(s['kerf']);tol=.001
F=float(DividerOffsetFromFront)
MotorMetadataData=json.loads(str(MotorMetadata))
px,pz,hole_d=[float(v) for v in (GuidePulleyPositionX,GuidePulleyPositionZ,GuidePulleyHoleDiameter)]
hole_r=hole_d/2.0
pulley_bore=3.0;pulley_od=12.0;pulley_width=4.0

def curve(v):
 if hasattr(v,'Value'):v=v.Value
 return v if isinstance(v,rg.Curve) else rs.coercecurve(v)
def curve_list(values):
 try:return [curve(v) for v in values]
 except TypeError:return [curve(values)]
def world(crv,y=F):
 c=crv.DuplicateCurve();p=rg.Plane(rg.Point3d(0,y,0),rg.Vector3d.XAxis,rg.Vector3d.ZAxis)
 c.Transform(rg.Transform.PlaneToPlane(rg.Plane.WorldXY,p));return c
def to_local(crv):
 c=curve(crv).DuplicateCurve();p=rg.Plane(rg.Point3d(0,F,0),rg.Vector3d.XAxis,rg.Vector3d.ZAxis)
 c.Transform(rg.Transform.PlaneToPlane(p,rg.Plane.WorldXY));return c
def cylinder(cx,cz,y,r,height):
 b=rg.Cylinder(rg.Circle(rg.Plane(rg.Point3d(cx,y,cz),rg.Vector3d.YAxis),r),height).ToBrep(True,True)
 if b.SolidOrientation==rg.BrepSolidOrientation.Inward:b.Flip()
 return b

def rect(x0,z0,x1,z1):
 return rg.PolylineCurve([rg.Point3d(x0,z0,0),rg.Point3d(x1,z0,0),rg.Point3d(x1,z1,0),rg.Point3d(x0,z1,0),rg.Point3d(x0,z0,0)])
def distance(point,curves,r):
 ds=[]
 for crv in curves:
  ok,u=crv.ClosestPoint(point);assert ok
  ds.append(point.DistanceTo(crv.PointAt(u))-r)
 return min(ds)

motor_curves=[to_local(c) for c in curve_list(MotorDividerEdges)]
motor_kerf=curve_list(MotorDividerKerfCenterlines)
base=to_local(BaseDividerEdges)
outer=max(motor_curves,key=lambda c:abs(rg.AreaMassProperties.Compute(c).Area))
inners=[c for c in motor_curves if c is not outer]
point=rg.Point3d(px,pz,0)
hole=rg.Circle(point,hole_r).ToNurbsCurve()
# Recover existing locating-tab regions from the untouched base divider outline.
W=float(MotorMetadataData['W']);H=float(MotorMetadataData['H'])
fit=float(s['fit']);floor=float(s['rim'])+t;upper=H-float(s['rim'])
xl=t+fit/2;xr=W-t-fit/2;zl=floor+fit/2;zh=upper-t-fit/2
tab_regions=[]
for window in [rect(-t,-t,xl,H+t),rect(xr,-t,W+t,H+t),rect(-t,-t,W+t,zl),rect(-t,zh,W+t,H+t)]:
 cs=rg.Curve.CreateBooleanIntersection(base,window,tol)
 if cs:tab_regions.extend(c for c in cs if abs(rg.AreaMassProperties.Compute(c).Area)>tol)
assert len(tab_regions)==8,'Could not identify all eight existing divider tabs'
edge_clearance=distance(point,[base],hole_r)
tab_clearance=distance(point,tab_regions,hole_r)
records=MotorMetadataData['records']
shaft=next(r for r in records if r['name']=='Center')
mounts=[r for r in records if r['name'].startswith('Mount')]
shaft_clearance=math.hypot(px-shaft['x'],pz-shaft['z'])-hole_r-float(shaft['radius'])
mount_clearance=min(math.hypot(px-r['x'],pz-r['z'])-hole_r-float(r['radius']) for r in mounts)
issues=[]
def require(ok,text):
 if not ok:issues.append(text)
require(base.Contains(point,rg.Plane.WorldXY,tol)==rg.PointContainment.Inside,'Guide pulley hole center is outside divider')
require(edge_clearance>=t-tol,'Guide pulley hole has less than one material thickness of divider-edge ligament')
require(tab_clearance>=t-tol,'Guide pulley hole is too close to a divider tab')
require(shaft_clearance>=t-tol,'Guide pulley hole is too close to motor shaft clearance')
require(mount_clearance>=t-tol,'Guide pulley hole is too close to a motor mounting hole')
# Ensure the complete front-side pulley preview stays within the divider outline.
require(distance(point,[base],pulley_od/2)>=-tol,'Pulley preview extends beyond divider edge')
PatternValid=not issues
candidate=motor_curves
if PatternValid:
 result=rg.Curve.CreateBooleanDifference(outer,inners+[hole],tol)
 fs=rg.Brep.CreatePlanarBreps(result,tol) if result else None
 require(fs is not None and len(fs)==1 and fs[0].IsValid,'Guide pulley subtraction invalidates divider')
 if not issues:
  candidate=[loop.To3dCurve() for loop in fs[0].Loops]
  removed=abs(rg.AreaMassProperties.Compute(outer).Area)-rg.AreaMassProperties.Compute(fs[0]).Area
  motor_removed=sum(abs(rg.AreaMassProperties.Compute(c).Area) for c in inners)
  require(abs(removed-motor_removed-math.pi*hole_r*hole_r)<tol,'Guide pulley cutout overlaps existing boundaries')
PatternValid=not issues
if not PatternValid:candidate=motor_curves
DividerEdges=[world(c) for c in candidate]
DividerKerfCenterlines=list(motor_kerf)
if PatternValid:
 kr=hole_r-kerf/2
 require(kr>tol,'Guide pulley kerf compensation collapses hole path')
 if kr>tol:DividerKerfCenterlines.append(world(rg.Circle(point,kr).ToNurbsCurve()))
# Pulley lies entirely in front of the divider; its axis is normal to the divider.
outer_pulley=cylinder(px,pz,F-pulley_width,pulley_od/2,pulley_width)
bore_tool=cylinder(px,pz,F-pulley_width-.1,pulley_bore/2,pulley_width+.2)
cut=rg.Brep.CreateBooleanDifference(outer_pulley,bore_tool,tol)
Pulley=cut[0] if cut else outer_pulley
Axis=rg.LineCurve(rg.Point3d(px,F-pulley_width-1,pz),rg.Point3d(px,F+t+1,pz))
RequestedHole=world(hole)
import System.Drawing as drawing
PatternColour=drawing.Color.FromArgb(0,0,0,0) if PatternValid else drawing.Color.FromArgb(255,230,50,40)
Metadata=json.dumps(dict(valid=PatternValid,issues=issues,x=px,z=pz,hole_diameter=hole_d,pulley_bore=pulley_bore,pulley_outer_diameter=pulley_od,pulley_width=pulley_width,distance_to_motor_shaft_clearance=shaft_clearance,distance_to_nearest_motor_mounting_hole=mount_clearance,distance_to_nearest_divider_edge=edge_clearance,distance_to_nearest_divider_tab=tab_clearance,side='Front side of Internal Divider'))
Report=('GUIDE PULLEY CENTER X=%.3f Z=%.3f mm\nGUIDE PULLEY HOLE %.3f mm\nDistance to motor shaft clearance %.3f mm\nDistance to nearest motor mounting hole %.3f mm\nDistance to nearest divider edge %.3f mm\nDistance to nearest divider tab %.3f mm\nPULLEY SIDE: Front side of Internal Divider\nPATTERN VALID: %s\n' % (px,pz,hole_d,shaft_clearance,mount_clearance,edge_clearance,tab_clearance,'YES' if PatternValid else 'NO'))
if issues:Report+='INVALID REQUEST: motor-cut divider retained; red curve shows requested pulley hole.\n'+'\n'.join(issues)
# ---------- end py3_8 ----------

# ---- group: 04 — Main Panels (continued)
crv = Curve([py3_4.KerfCenterlines, py3_8.DividerKerfCenterlines, py3_6.GuideKerfCenterline, py3_5.MountKerfCenterlines])

# ---- group: 05 — Internal Divider (continued)
boundary_6 = BoundarySurfaces(Edges=py3_8.DividerEdges)
extr_6 = Extrude(Base=boundary_6, Direction=py3_2.Direction)
cap_6 = CapHoles(Brep=extr_6)

# ---- group: 06 — 3D Assembly Preview
# Five colours = five sheet parts.
# Top and Left translucent for inspection.
# Grey screws enter Left/Right only.
# Brass captive nuts remain in Top/Bottom T-slots.
# Upper hardware entirely below common Top/Left/Right plane.
# Front AND rear open; no external Back.
# Divider unchanged: 30 mm from front, tabs only.
swatch_2 = ColourSwatch(SwatchColor=RGBA(72, 156, 215, 160))
swatch_3 = ColourSwatch(SwatchColor=RGB(80, 88, 100))
swatch_4 = ColourSwatch(SwatchColor=RGB(183, 153, 87))
preview_10 = CustomPreview(Geometry=cap_2, Material=swatch_2)
preview_11 = CustomPreview(Geometry=cap_5, Material=ColourSwatch(SwatchColor=RGB(236, 177, 64)))
preview_12 = CustomPreview(Geometry=cap_3, Material=ColourSwatch(SwatchColor=RGBA(210, 104, 83, 140)))
preview_13 = CustomPreview(Geometry=cap_4, Material=ColourSwatch(SwatchColor=RGB(93, 177, 159)))
preview_14 = CustomPreview(Geometry=cap_6, Material=ColourSwatch(SwatchColor=RGB(68, 196, 203)))
preview_15 = CustomPreview(Geometry=py3_4.Screws, Material=swatch_3)
preview_16 = CustomPreview(Geometry=py3_4.Nuts, Material=swatch_4)
py3_9 = Python3Script(
    Panels=[cap_2, cap_5, cap_3, cap_4, cap_6],
    Metadata=py3_5.PanelMetadataOut,
    Hardware=[py3_4.Screws, py3_4.Nuts],
    MotorStatus=py3_7.Metadata)  # -> out, Valid, Checks; inputs Panels: tree, Hardware: tree
# ---------- py3_9: Python ----------
"""Verify five actual solved sheet Breps and all hardware, not just dimensions.
Upper nut retaining/anti-rotation probes are in its REAL overlap with Top.
The divider's geometry is independently compared with its pre-edit snapshot.
"""
import Rhino.Geometry as rg
import rhinoscriptsyntax as rs
import json
m=json.loads(str(Metadata)); s=m['spec']; t=s['t']; tol=0.001
names=['Top','Bottom','Left','Right','Internal Divider']
def brep(x):
 if hasattr(x,'Value'):x=x.Value
 return x if isinstance(x,rg.Brep) else rs.coercebrep(x)
raw=[brep(x) for branch in Panels.Branches for x in branch]
hardware=[brep(x) for branch in Hardware.Branches for x in branch]
checks=[]
def check(ok,text):
 checks.append(('PASS | ' if ok else 'FAIL | ')+text)
 assert ok,text
check(len(raw)==5,'PANEL COUNT = 5')
byname={}
for b in raw:
 bb=b.GetBoundingBox(True)
 if abs(bb.Max.Z-bb.Min.Z-t)<tol:name='Top' if bb.Min.Z>m['H']/2 else 'Bottom'
 elif abs(bb.Max.X-bb.Min.X-t)<tol:name='Right' if bb.Min.X>m['W']/2 else 'Left'
 else:
  assert abs(bb.Min.Y-m['F'])<tol,'Unexpected rear closing sheet'
  name='Internal Divider'
 assert name not in byname,'Duplicate physical panel'
 byname[name]=b
bs=[byname[name] for name in names]
check(all(b.IsValid and b.IsSolid for b in bs),'5 valid closed sheet solids; SEPARATE BACK PANEL = NO')
bb=rg.BoundingBox.Empty
for b in bs:bb.Union(b.GetBoundingBox(True))
actual=[bb.Max.X-bb.Min.X,bb.Max.Z-bb.Min.Z,bb.Max.Y-bb.Min.Y]
check(all(abs(a-b)<tol for a,b in zip(actual,[m['W'],m['upper_plane'],m['open_rear']])), 'Sheet envelope W x H x D = %.3f x %.3f x %.3f mm'%tuple(actual))
for name,b in byname.items():
 box=b.GetBoundingBox(True)
 d=(box.Max.Z-box.Min.Z) if name in ['Top','Bottom'] else (box.Max.X-box.Min.X) if name in ['Left','Right'] else box.Max.Y-box.Min.Y
 check(abs(d-t)<tol,name+' material thickness = %.3f mm'%d)
planes=[byname[name].GetBoundingBox(True).Max.Z for name in ['Top','Left','Right']]
step=max(planes)-min(planes)
check(step<tol and abs(planes[0]-m['upper_plane'])<tol,'TOP / LEFT / RIGHT upper plane = %.3f mm; VERTICAL STEP = %.3f mm'%(planes[0],step))
check(all(b.GetBoundingBox(True).Max.Z<=planes[0]+tol for b in bs),'All sheet tabs and joint features at or below common upper plane')

def intersection_volume(a,b):
 common=rg.Brep.CreateBooleanIntersection(a,b,tol)
 return sum(abs(rg.VolumeMassProperties.Compute(x).Volume) for x in common if x.IsSolid) if common else 0.0
intersections=[]
for i in range(len(bs)):
 for j in range(i+1,len(bs)):
  vol=intersection_volume(bs[i],bs[j])
  if vol>0.005:intersections.append('%s / %s = %.4f'%(names[i],names[j],vol))
check(not intersections,'No sheet-to-sheet solid interpenetrations'+(' : '+str(intersections) if intersections else ''))

for joint in m['joints']:
 recv=byname[joint['receiver']];sender=byname[joint['sender']]
 p=rg.Point3d(*joint['entry']);q=rg.Point3d(*joint['seat']);u=rg.Vector3d(*joint['tangent']);a=rg.Vector3d(*joint['axis'])
 assert not recv.IsPointInside(p,tol,True),'Blocked screw clearance'
 # Upper axis sits below the Top underside. Test the material overlap band,
 # not empty space below the sheet, for the nut seat and retaining shoulders.
 if joint['sender']=='Top':q.Z=m['flat_probe_z']
 for sign in [-1,1]:
  assert not sender.IsPointInside(q+u*(sign*s['nut_width']*.48),tol,True),'Nut crossbar too narrow'
  assert sender.IsPointInside(q+a*(sign*(s['nut_depth']/2+.3))+u*(s['hole']/2+.4),tol,True),'Missing axial nut-retaining shoulder'
  assert sender.IsPointInside(q+u*(sign*(s['nut_width']/2+.3)),tol,True),'Missing nut anti-rotation wall'
check(len(m['joints'])==8 and all(j['receiver'] in ['Left','Right'] and j['sender'] in ['Top','Bottom'] for j in m['joints']),'8 M3 joints: Left/Right screws -> Top/Bottom captive nuts; NO rear-cap joints')
check(m['flat_overlap']>.5,'Upper nut anti-rotation flats overlap Top by %.3f mm'%m['flat_overlap'])
check(len(hardware)==24 and all(b.IsValid and b.IsSolid for b in hardware),'8 screw shanks + 8 heads + 8 captive hex nuts; valid hardware solids')
hardware_high=max(b.GetBoundingBox(True).Max.Z for b in hardware)
expected_nut_high=m['top_axis_z']+s['af']/(3**0.5)
check(abs(hardware_high-expected_nut_high)<tol,'Hardware envelope matches captive-nut top: %.3f mm'%hardware_high)
protrusion=max(0.0,hardware_high-planes[0])
expected_protrusion=max(0.0,expected_nut_high-planes[0])
check(abs(protrusion-expected_protrusion)<tol,'Top-plane projection matches expected captive-nut envelope: %.3f mm'%protrusion)
if expected_protrusion>tol:
 checks.append('EXPECTED | CAPTIVE-NUT PROTRUSION ABOVE TOP = %.3f mm at UpperJointOffsetZ = %.3f mm; hardware collision checks remain active.'%(expected_protrusion,m.get('upper_joint_offset_z',0.0)))
else:
 checks.append('PASS | HARDWARE ABOVE TOP PLANE = NONE; hardware maximum Z %.3f; clearance %.3f mm'%(hardware_high,planes[0]-hardware_high))
# Broad-phase bounding boxes avoid booleans for remote hardware/parts.
hardware_hits=[]
for i,h in enumerate(hardware):
 hb=h.GetBoundingBox(True)
 for name,b in byname.items():
  pb=b.GetBoundingBox(True)
  if hb.Max.X<pb.Min.X+tol or hb.Min.X>pb.Max.X-tol or hb.Max.Y<pb.Min.Y+tol or hb.Min.Y>pb.Max.Y-tol or hb.Max.Z<pb.Min.Z+tol or hb.Min.Z>pb.Max.Z-tol:continue
  vol=intersection_volume(h,b)
  if vol>.005:hardware_hits.append('%d / %s = %.4f'%(i,name,vol))
check(not hardware_hits,'No hardware-to-sheet interpenetrations'+(' : '+str(hardware_hits) if hardware_hits else ''))

# Original Top/Bottom depth retained. Removing the cap also removes ALL its
# notches and protruding tabs: the existing rear shoulder is now the open edge.
for name in ['Top','Bottom']:
 b=byname[name];z=b.GetBoundingBox(True).Center.Z
 for i in range(1,400):
  x=t+(m['W']-2*t)*i/400
  assert b.IsPointInside(rg.Point3d(x,m['open_rear']-.02,z),tol,True),'Residual rear-cap T-slot or broken rear edge'
check(True,'All rear-cap tabs, notches, T-slots and fasteners removed')
div=byname['Internal Divider'].GetBoundingBox(True)
check(abs(div.Min.Y-m['F'])<tol,'DIVIDER OFFSET FROM FRONT = %.3f mm'%div.Min.Y)
rear=m['open_rear']-div.Max.Y
check(rear>0,'Clear depth behind divider to OPEN REAR = %.3f mm'%rear)
broad=[]
for face in byname['Internal Divider'].Faces:
 if face.IsPlanar(tol) and abs(face.NormalAt(.5,.5).Y)>.99:broad.append(face)
motor=json.loads(str(MotorStatus))
check(len(broad)==2 and all(f.Loops.Count==2+motor['applied_holes'] for f in broad),'Divider preserves original outline/tabs; motor apertures = '+str(motor['applied_holes'])+'; guide-pulley apertures = 1')
check(not any('Divider' in j['sender'] or 'Divider' in j['receiver'] for j in m['joints']),'Divider-to-enclosure support remains tabs only; motor attachment is separate')
for y,word in [(0,'FRONT'),(m['open_rear'],'REAR')]:
 for fx in [.2,.5,.8]:
  for fz in [.2,.5,.8]:
   p=rg.Point3d(m['W']*fx,y,m['upper_plane']*fz)
   assert not any(b.IsPointInside(p,tol,False) for b in bs),word+' blocked by a closing sheet'
 check(True,word+' = OPEN')
# Verify the selected OS20 M4 openings on the actual terminal Top solid.
mount=m['ceiling_mount'];holes=mount['holes'];top=byname['Top'];round_walls=[]
expected_count=6 if mount['extra_enabled'] else 4
cx=m['W']/2.0;cy=m['open_rear']/2.0;p=mount['grid_pitch']
expected_centers={'Front Left':(cx-p,cy-p),'Front Right':(cx+p,cy-p),'Rear Left':(cx-p,cy+p),'Rear Right':(cx+p,cy+p)}
if mount['extra_enabled']:
 expected_centers.update({'Extra Left':(cx-2*p,cy),'Extra Right':(cx+2*p,cy)})
check(mount['hole_count']==expected_count and len(holes)==expected_count,'OS20 mount configuration contains exactly %d holes'%expected_count)
check(abs(mount['diameter']-4.5)<tol,'Top M4 clearance-hole diameter = %.3f mm'%mount['diameter'])
check(abs(mount['center_x']-cx)<tol and abs(mount['center_y']-cy)<tol and all(h['name'] in expected_centers and abs(h['x']-expected_centers[h['name']][0])<tol and abs(h['y']-expected_centers[h['name']][1])<tol for h in holes),'All M4 centers follow the center-origin OS20 formulas')
for face in top.Faces:
 ok,cyli=face.TryGetCylinder(tol)
 if ok:round_walls.append(cyli)
check(len(round_walls)==expected_count,'TOP M4 MOUNTING HOLES = exactly %d circular through-holes'%expected_count)
for hole in holes:
 matches=[cyli for cyli in round_walls if abs(cyli.Center.X-hole['x'])<tol and abs(cyli.Center.Y-hole['y'])<tol and abs(cyli.Radius-hole['radius'])<tol and abs(cyli.Axis.Z)>.999]
 assert len(matches)==1,'Missing or incorrectly sized M4 hole'
 z=(m['zt']+m['upper_plane'])/2
 assert not top.IsPointInside(rg.Point3d(hole['x'],hole['y'],z),tol,True),'Mount hole not open'
 # Ring probes in actual Top material supplement exact curve-to-curve clearances.
 import math
 for i in range(72):
  angle=i*math.pi/36;radius=hole['radius']+mount['minimum_ligament']/2
  pnt=rg.Point3d(hole['x']+radius*math.cos(angle),hole['y']+radius*math.sin(angle),z)
  assert top.IsPointInside(pnt,tol,True),'Mount hole lacks surrounding material'
 check(hole['inside_material'],hole['name']+' mount | outline %.3f | body edge %.3f | T-slot %.3f | Divider slot %.3f | other hole %.3f mm'%(hole['panel_outline_clearance'],hole['body_edge_clearance'],hole['tslot_clearance'],hole['divider_slot_clearance'],hole['other_mount_clearance']))
check(mount['minimum_hole_hole_clearance']>=mount['minimum_ligament']-tol,'Minimum M4 hole-to-hole ligament = %.3f mm'%mount['minimum_hole_hole_clearance'])
check(mount['minimum_hole_feature_clearance']>=mount['minimum_ligament']-tol,'Minimum M4 hole-to-feature ligament = %.3f mm'%mount['minimum_hole_feature_clearance'])
broad_top=[face for face in top.Faces if face.IsPlanar(tol) and abs(face.NormalAt(.5,.5).Z)>.99]
check(len(broad_top)==2 and all(face.Loops.Count==expected_count+3 for face in broad_top),'Both Top faces contain %d M4 holes + 2 unchanged Divider slots; through-cuts verified'%expected_count)
checks.append('NOTE | H and D remain original reference sliders; corrected actual height H-rim and depth D-T are reported above.')
# Modification 04: add Right mounting checks without replacing any enclosure checks above.
right_mount=m['right_mount'];right=byname['Right'];right_holes=right_mount['holes']
allowed_pcb={'R1C1','R1C3','R4C1','R4C3'};omitted={'R2C2','R3C2'}
check(set(right_mount['approved_exception_ids'])==allowed_pcb,'Right exceptions restricted to exactly four PCB IDs')
check(abs(right_mount['minimum_ligament']-3.0)<tol,'Right standard material-ligament policy remains 3.000 mm')
check(len(right_holes)==right_mount['hole_count'] and len(right_holes)==4+right_mount['universal_count'],'Right mounting count = %d; four PCB references remain enabled'%len(right_holes))
check(not any(r['id'] in omitted for r in right_holes),'R2C2 and R3C2 remain omitted; no relocation')
check(right.IsValid and right.IsSolid,'Right remains a valid closed Brep')
wall_cylinders=[]
for face in right.Faces:
 ok,cyli=face.TryGetCylinder(tol)
 if ok:wall_cylinders.append(cyli)
mount_walls=[c for c in wall_cylinders if abs(c.Radius-right_mount['diameter']/2)<tol and abs(c.Axis.X)>.999]
check(len(mount_walls)==len(right_holes),'Exactly %d new Right cylindrical through-holes'%len(right_holes))
check(len(wall_cylinders)==len(right_holes)+4,'Four unchanged enclosure screw holes remain separate')
for hole in right_holes:
 expected_u=right_mount['inset_left']+(int(hole['id'][3])-1)*right_mount['grid_pitch']
 expected_v=right_mount['inset_top']+(int(hole['id'][1])-1)*right_mount['grid_pitch']
 check(abs(hole['u']-expected_u)<tol and abs(hole['v']-expected_v)<tol,hole['id']+' follows the fixed PCB-anchored OS20 coordinates')
 matches=[c for c in mount_walls if abs(c.Center.Y-hole['u'])<tol and abs(c.Center.Z-(m['upper_plane']-hole['v']))<tol]
 check(len(matches)==1,hole['id']+' has the configured finished hole diameter')
 for x in [m['W']-t+.01,m['W']-t/2,m['W']-.01]:
  assert not right.IsPointInside(rg.Point3d(x,hole['u'],m['upper_plane']-hole['v']),tol,True),'Blocked Right mount through-thickness'
 clearance=hole['minimum_feature_clearance']
 check(clearance>1e-7,hole['id']+' has no geometric overlap')
 check(hole['other_mount_clearance']>=3.0-tol,hole['id']+' maintains 3 mm to every other new mount')
 if hole['id'] in allowed_pcb and clearance<3.0:
  assert hole['classification']=='PCB EXCEPTION — positive clearance below 3 mm','PCB exception classification suppressed'
  checks.append('PCB EXCEPTION — positive clearance below 3 mm | %s | actual minimum %.6f mm | %s'%(hole['id'],clearance,hole['limiting_feature']))
 else:
  check(clearance>=3.0-tol,hole['id']+' satisfies standard 3 mm ligament; actual %.6f mm'%clearance)
pcb={r['id']:r for r in right_holes if r['pcb']}
check(abs(pcb['R1C3']['u']-pcb['R1C1']['u']-2*right_mount['grid_pitch'])<tol and abs(pcb['R4C1']['v']-pcb['R1C1']['v']-3*right_mount['grid_pitch'])<tol,'PCB rectangle = %.6f x %.6f mm'%(pcb['R1C3']['u']-pcb['R1C1']['u'],pcb['R4C1']['v']-pcb['R1C1']['v']))
right_faces=[f for f in right.Faces if f.IsPlanar(tol) and abs(f.NormalAt(.5,.5).X)>.99]
check(len(right_faces)==2 and all(f.Loops.Count==right_mount['profile_count'] for f in right_faces),'Both Right faces have %d fabrication loops'%right_mount['profile_count'])
for row in right_mount['candidates']:
 if row['id'] in omitted:
  assert not any(abs(c.Center.Y-row['u'])<tol and abs(c.Center.Z-row['z'])<tol for c in mount_walls),'Omitted point has a hole wall'
  check(right.IsPointInside(rg.Point3d(m['W']-t/2,row['u'],row['z']),tol,True),row['id']+' center remains material, not a new cut')
check(right_mount['minimum_other_mount_clearance']>=3.0-tol,'Right hole-to-hole minimum = %.6f mm'%right_mount['minimum_other_mount_clearance'])
check(abs(right_mount['kerf_centerline_diameter']-(right_mount['diameter']-s['kerf']))<tol,'Right laser centerline diameter = %.6f mm'%right_mount['kerf_centerline_diameter'])
checks.append('STRICT RIGHT LIGAMENT VALID = %s; APPROVED WITH EXPLICIT PCB EXCEPTIONS = %s'%(right_mount['strict_valid'],right_mount['approved_valid']))
checks.append('HARDWARE REVIEW | PCB screw-head access and middle-column Divider interference remain unapproved; no hardware geometry changed.')
Valid=True
Checks='\n'.join(checks)
# ---------- end py3_9 ----------
panel_9 = Panel(py3_9.Valid)
panel_10 = Panel(py3_9.Checks)

# ---- group: 09 — 28BYJ-48 Motor Mounting Interface (continued)
preview_17 = CustomPreview(Geometry=py3_7.Screws, Material=swatch_3)
py3_10 = Python3Script(Divider=cap_6, MotorMetadata=py3_7.Metadata)  # -> out, PatternValid, Validation
# ---------- py3_10: Python ----------
"""Terminal native-divider checks for the rigid three-hole motor interface."""
import Rhino.Geometry as rg
import rhinoscriptsyntax as rs
import json
m=json.loads(str(MotorMetadata));tol=.001
v=Divider.Value if hasattr(Divider,'Value') else Divider
b=v if isinstance(v,rg.Brep) else rs.coercebrep(v)
checks=[]
def check(ok,text):
 checks.append(('PASS | ' if ok else 'FAIL | ')+text)
 assert ok,text
check(b.IsValid and b.IsSolid,'Divider remains one valid planar-profile sheet solid')
box=b.GetBoundingBox(True)
check(abs(box.Min.Y-m['F'])<tol and abs(box.Max.Y-m['F']-m['t'])<tol,'Divider position/thickness preserved')
rounds=[]
for face in b.Faces:
 ok,c=face.TryGetCylinder(tol)
 if ok:rounds.append(c)
check(len(rounds)>=m['applied_holes'],'Final divider contains all 3 motor apertures; total circular through-holes = '+str(len(rounds)))
if m['valid']:
 for r in m['records']:
  matched=[c for c in rounds if abs(c.Center.X-r['x'])<tol and abs(c.Center.Z-r['z'])<tol and abs(c.Radius-r['radius'])<tol and abs(c.Axis.Y)>.999]
  check(len(matched)==1,r['name']+' diameter and center match requested rigid pattern')
  q=rg.Point3d(r['x'],m['F']+m['t']/2,r['z'])
  check(not b.IsPointInside(q,tol,True),r['name']+' hole passes through full sheet thickness')
 broad=[f for f in b.Faces if f.IsPlanar(tol) and abs(f.NormalAt(.5,.5).Y)>.999]
 check(len(broad)==2 and all(f.Loops.Count>=4 for f in broad),'Both divider faces retain the original outline and all 3 motor apertures')
 check(m['body_front']>=box.Max.Y-tol,'Motor body/flange entirely on REAR side')
 check(m['shaft_tip']<box.Min.Y,'Output shaft projects toward OPEN FRONT')
 checks.append('PASS | PATTERN VALID = YES; existing panels, bracket, tabs and joints remain unchanged')
else:
 checks.append('PATTERN VALID = NO | Requested slider values retained. Unsafe holes were NOT applied.')
 checks.extend(m['issues'])
PatternValid=m['valid']
Validation='\n'.join(checks)
# ---------- end py3_10 ----------
panel_11 = Panel(py3_10.PatternValid)
panel_12 = Panel(py3_10.Validation)

# ---- group: 08 — Microswitch Bracket + Mounting Interfaces (continued)
preview_18 = CustomPreview(Geometry=py3_3.Screws, Material=swatch_3)
preview_19 = CustomPreview(Geometry=py3_3.Nuts, Material=swatch_4)
py3_11 = Python3Script(
    Bracket=cap,
    Panels=[cap_2, cap_5, cap_3, cap_4, cap_6],
    BracketHardware=[py3_3.Screws, py3_3.Nuts],
    Reference=[py3_3.SwitchBody, py3_3.Lever, py3_3.Roller],
    ExistingHardware=[py3_4.Screws, py3_4.Nuts],
    Metadata=py3_3.Metadata,
    Spec=py3.Spec)  # -> out, Valid, Validation; inputs Panels: tree, BracketHardware: tree, Reference: tree, ExistingHardware: tree
# ---------- py3_11: Python ----------
"""Verify actual bracket, receiver interfaces, hardware and switch references."""
import Rhino.Geometry as rg
import rhinoscriptsyntax as rs
import json,math
m=json.loads(str(Metadata));tol=.001;t=m['t']
def brep(v):
 if hasattr(v,'Value'):v=v.Value
 return v if isinstance(v,rg.Brep) else rs.coercebrep(v)
def flatten(tree):return [brep(v) for branch in tree.Branches for v in branch]
b=brep(Bracket);panels=flatten(Panels);hw=flatten(BracketHardware);refs=flatten(Reference);oldhw=flatten(ExistingHardware)
byname={}
for p in panels:
 bb=p.GetBoundingBox(True)
 if abs(bb.Max.Z-bb.Min.Z-t)<tol:name='Top' if bb.Min.Z>m['H']/2 else 'Bottom'
 elif abs(bb.Max.X-bb.Min.X-t)<tol:name='Left' if bb.Min.X<m['W']/2 else 'Right'
 else:name='Divider'
 byname[name]=p
checklines=[]
def check(ok,text):
 checklines.append(('PASS | ' if ok else 'FAIL | ')+text);assert ok,text
check(len(panels)==5 and len(byname)==5,'Existing five-panel enclosure retained; bracket is one additional sheet part')
check(b.IsValid and b.IsSolid,'Bracket is one valid closed planar-profile extrusion')
bb=b.GetBoundingBox(True);div=byname['Divider'].GetBoundingBox(True)
check(abs(bb.Max.Y-bb.Min.Y-t)<tol,'Bracket thickness equals MaterialThickness = %.3f mm'%t)
gap=div.Min.Y-bb.Max.Y
check(gap>0 and abs(gap-m['offset'])<tol,'BRACKET POSITION FROM DIVIDER = %.3f mm'%gap)
check(bb.Min.Y>0 and bb.Max.Y<div.Min.Y,'Bracket lies entirely in FRONT chamber')
# Edge-tab tips reach outside X=0 and Bottom lower face, while shoulders seat
# at X=T and Bottom upper face. Full solid intersection tests verify the fit.
check(abs(bb.Min.X)<tol and abs(bb.Min.Z-byname['Bottom'].GetBoundingBox(True).Min.Z)<tol,'Corner bracket locating tabs fully enter Left and Bottom')
def volume_intersection(a,b):
 ab=a.GetBoundingBox(True);bb=b.GetBoundingBox(True)
 if ab.Max.X<bb.Min.X+tol or ab.Min.X>bb.Max.X-tol or ab.Max.Y<bb.Min.Y+tol or ab.Min.Y>bb.Max.Y-tol or ab.Max.Z<bb.Min.Z+tol or ab.Min.Z>bb.Max.Z-tol:return 0.0
 r=rg.Brep.CreateBooleanIntersection(a,b,tol)
 return sum(abs(rg.VolumeMassProperties.Compute(x).Volume) for x in r if x.IsSolid) if r else 0
for name,p in byname.items():check(volume_intersection(b,p)<.005,'Bracket / '+name+' do not interpenetrate')
check(True,'BRACKET INTERSECTS DIVIDER = NO')
check(len(m['joints'])==2 and sorted(j['receiver'] for j in m['joints'])==['Bottom','Left'],'Exactly two attachment joints: one Left -> bracket, one Bottom -> bracket')
check(len(hw)==6 and all(v.IsValid and v.IsSolid for v in hw),'TOTAL BRACKET FASTENERS = 2 (2 shanks, 2 heads, 2 nuts)')
for j in m['joints']:
 receiver=byname[j['receiver']];p=rg.Point3d(*j['entry']);q=rg.Point3d(*j['seat']);a=rg.Vector3d(*j['axis']);u=rg.Vector3d(*j['tangent'])
 check(not receiver.IsPointInside(p,tol,True),j['receiver']+' contains its screw-clearance hole')
 check(not b.IsPointInside(q,tol,True),j['receiver']+' screw enters a real captive-nut T-slot in bracket')
 for k in [-1,1]:
  # Nominal M3 nut dimensions in this geometry are recovered from actual
  # template metadata through the extra Spec input, not hard-coded below.
  s=json.loads(str(Spec))
  assert not b.IsPointInside(q+u*(k*s['nut_width']*.48),tol,True),'Missing full-width nut crossbar'
  assert b.IsPointInside(q+a*(k*(s['nut_depth']/2+.3))+u*(s['hole']/2+.4),tol,True),'Missing captive-nut retaining shoulder'
  assert b.IsPointInside(q+u*(k*(s['nut_width']/2+.3)),tol,True),'Missing captive-nut anti-rotation wall'
 for receiver_name in ['Left','Bottom']:
  if receiver_name==j['receiver']:
   rounds=[]
   for face in receiver.Faces:
    ok,cy=face.TryGetCylinder(tol)
    if ok and abs(cy.Radius-s['hole']/2)<tol:
     # Center need only align with the screw axis; cylinder axial origin varies.
     delta=cy.Center-p;along=rg.Vector3d.Multiply(delta,a);transverse=delta-a*along
     if transverse.Length<tol:rounds.append(cy)
   assert len(rounds)==1,'Exactly one new clearance hole must match each bracket screw'
# Hardware must clear sheets, divider, existing M3 hardware and switch reference.
for i,h in enumerate(hw):
 for name,p in list(byname.items())+[('bracket',b)]:assert volume_intersection(h,p)<.005,'Bracket hardware collides with '+name
 for old in oldhw:assert volume_intersection(h,old)<.005,'Bracket hardware collides with existing enclosure joint'
 for r in refs:assert volume_intersection(h,r)<.005,'Bracket hardware collides with switch reference'
check(True,'Both bracket fasteners clear all sheet parts, existing joints and switch reference')
# Two inner loops in both broad faces are the two capsule slots.
broads=[]
for face in b.Faces:
 if face.IsPlanar(tol) and abs(face.NormalAt(.5,.5).Y)>.99:broads.append(face)
check(len(broads)==2 and all(f.Loops.Count==3 for f in broads),'MICROSWITCH MOUNTING FEATURES = 2 through-slots')
slot_boxes=[]
for loop in broads[0].Loops:
 if loop.LoopType==rg.BrepLoopType.Inner:slot_boxes.append(loop.To3dCurve().GetBoundingBox(True))
slot_boxes.sort(key=lambda x:x.Center.X)
actual_pitch=slot_boxes[1].Center.X-slot_boxes[0].Center.X
actual_height=slot_boxes[0].Center.Z-byname['Bottom'].GetBoundingBox(True).Max.Z
check(abs(actual_pitch-m['mount_pitch'])<tol,'MICROSWITCH HOLE SPACING = %.3f mm'%actual_pitch)
check(abs(actual_height-m['mount_height'])<tol and abs(slot_boxes[1].Center.Z-slot_boxes[0].Center.Z)<tol,'MICROSWITCH HOLE AXIS ABOVE BOTTOM = %.3f mm'%actual_height)
for sb in slot_boxes:
 assert abs(sb.Max.Z-sb.Min.Z-m['mount_diameter'])<tol and abs(sb.Max.X-sb.Min.X-(m['mount_diameter']+m['adjustment']))<tol,'Incorrect horizontal capsule slot dimensions'
check(True,'Slots %.3f x %.3f mm; shared total horizontal travel %.3f mm'%(m['mount_diameter']+m['adjustment'],m['mount_diameter'],m['adjustment']))
for r in refs:
 rb=r.GetBoundingBox(True)
 assert rb.Min.X>=t-tol and rb.Max.X<=m['W']-t+tol and rb.Min.Y>0 and rb.Max.Y<div.Min.Y and rb.Min.Z>=m['floor']-tol and rb.Max.Z<m['upper']-t+tol,'Switch reference outside front chamber'
 for name,p in list(byname.items())+[('bracket',b)]:assert volume_intersection(r,p)<.005,'Switch reference intersects '+name
check(True,'Approximate KW11 body/roller remain entirely inside front chamber and clear all sheet parts')
check(abs(m['body_y_range'][0]-bb.Max.Y)<tol and m['body_y_range'][1]<div.Min.Y,'MICROSWITCH BODY mounts on bracket REAR face and occupies Divider side')
roller=rg.Point3d(*m['roller_center']);underside=roller.Z-m['roller_radius']
check(roller.DistanceTo(rg.Point3d(34.0,19.8,24.7))<tol,'ROLLER CENTER translated rigidly to X=34.000 Y=19.800 Z=24.700 mm')
check(roller.X>m['body_x_range'][1] and roller.Y>m['body_y_range'][1],'ROLLER remains on RIGHT side and rear of switch body')
for i in range(1,100):
 z=m['floor']+(underside-m['floor'])*i/100
 q=rg.Point3d(roller.X,roller.Y,z)
 blocked=[(j,str(v.GetBoundingBox(True))) for j,v in enumerate([b]+panels+hw+oldhw+refs) if v.GetBoundingBox(True).Contains(q) and v.IsPointInside(q,tol,True)]
 assert not blocked,'Vertical roller actuation centerline blocked at '+str(q)+' by '+str(blocked)
check(bb.Max.Y<m['body_y_range'][1] and m['body_y_range'][1]<div.Min.Y,'ASSEMBLY ORDER = OPEN FRONT -> bracket -> microswitch body -> Internal Divider')
check(True,'OPEN-FRONT CLEARANCE = %.3f mm (Y=0 to frontmost bracket/switch feature)'%m['front_space'])
check(True,'Vertical actuation centerline clear for %.3f mm above Bottom; tube diameter not yet defined'%m['guide_clear_height'])
checklines.append('NOTE | Switch body and lever are approximate references, not a manufacturer-verified KW11 model. No guide-tube hole or fabrication layout.')
Valid=True
Validation='\n'.join(checklines)
# ---------- end py3_11 ----------
panel_13 = Panel(py3_11.Valid)
panel_14 = Panel(py3_11.Validation)
